# Grasshopper definition 231128_QLA_MT_functioning.ghx (Grasshopper 1.0.8)
# plug-ins: Karamba3D, RhinoCodePluginGH, Human

crv = Curve(<curve referenced from the Rhino model>)
# LOADS
S = Script()  # -> out, a
# ---------- S: C# ----------
// Grasshopper Script Instance
using System;
using System.Collections;
using System.Collections.Generic;
using System.Drawing;

using Rhino;
using Rhino.Geometry;

using Grasshopper;
using Grasshopper.Kernel;
using Grasshopper.Kernel.Data;
using Grasshopper.Kernel.Types;

public class Script_Instance : GH_ScriptInstance
{
  /* 
    Members:
      RhinoDoc RhinoDocument
      GH_Document GrasshopperDocument
      IGH_Component Component
      int Iteration

    Methods (Virtual & overridable):
      Print(string text)
      Print(string format, params object[] args)
      Reflect(object obj)
      Reflect(object obj, string method_name)
  */
  
  private void RunScript(object x, object y, ref object a)
  {
    // Write your logic here
    Point3d ays = new Point3d(0,0,0);
    a = ays;
  }
}
# ---------- end S ----------
S_2 = Script(x=crv)  # -> out, a, ays; inputs x: Curve
# ---------- S_2: Python ----------
a = 4
b =6

print (a+b)


import rhinoscriptsyntax as rs

ays = rs.DivideCurve(x, 5)

def DivideCurve(curve, segment):
    .....
    return points
# ---------- end S_2 ----------

node_type = ValueList({"Support": "1", "Load": "2", "Float": "3", "End": "4", "Corner": "5", "Tri": "6", "Quad": "7"}, selected="Load")
tail = Point(<point referenced from the Rhino model>)
pt = Point(<point referenced from the Rhino model>)
tail_2 = Point(tail)
head = Point(pt)
support_points_input = PythonScript(Tail=tail_2, Head=head, Type=node_type)  # -> AppliedForce, Color, Node; inputs Tail: Point3d, Head: Point3d
# ---------- support_points_input: Python ----------
import rhinoscriptsyntax as rs
import ghpythonlib.components as gh
import Rhino.Geometry as rg
import Rhino as rc
import System.Drawing as sd

import Assembly as assembly
import Grammar as gr
import Rules as r
import GraphicStatics as gs

reload (assembly)
reload (gs)

################################################################################

AppliedForce = gh.Line(Tail, Head) #GH Line Object

################################################################################
# IDENTIFY & ASSIGN

"""
Pass = 0
Support = 1
Load = 2
Float = 3
End = 4
Corner = 5
Tri = 6
Quad = 7
"""

if Type == "1": #Support Point
    ThisNodeType = assembly.NodeType.Support
    ThisForceType = assembly.ForceType.Reaction
    Color = "252, 223,33" #yellow, for support reactions

if Type == "2": #Load Point
    ThisNodeType = assembly.NodeType.Load
    ThisForceType = assembly.ForceType.Applied
    Color = "0, 113, 189" #blue, for applied loads

################################################################################
# CONSTRUCT ASSEMBLY.FORCE

ForceList=[]
Force = assembly.Force(AppliedForce, ThisForceType, -1)
ForceList.append(Force)


Node = assembly.Node(Head, ThisNodeType, ForceList)

Node = gs.RearrangeForces(Node)
Node = gs.EquilibrateNode(Node)
print Node.Forces
################################################################################

"""
print Node.Coordinate
print ThisNodeType
print "Force Head = ", Head
print "Force Tail = ", Tail
print Color 
"""
# ---------- end support_points_input ----------
data = Data(support_points_input.Color)
data_2 = Data(support_points_input.AppliedForce)
# MT
line = Line(data_2)
vdisex = VectorDisplayEx(Point=tail_2, Vector=data_2, Colour=data, Width="2")
end = EndPoints(Curve=line)  # -> Start, End
vec2pt = Vector2Pt(PointA=end.End, PointB=end.Start, Unitize=False)  # -> Vector, Length
rad = Radians(Degrees="15")
rotate = Rotate(Geometry=vec2pt.Vector, Angle=expr("x*-1", rad), Plane=PlaneXY(0, 0, 0))  # -> Geometry, Transform
rotate_2 = Rotate(Geometry=vec2pt.Vector, Angle=rad, Plane=PlaneXY(0, 0, 0))  # -> Geometry, Transform
tension_compresion = Number("-1")
amp = Amplitude(Vector=vec2pt.Vector, Amplitude="1")
amp_2 = Amplitude(Vector=rotate_2.Geometry, Amplitude="1.5")
amp_3 = Amplitude(Vector=rotate.Geometry, Amplitude="1.5")
equals = Equality(FirstNumber=tension_compresion, SecondNumber=1)  # -> Equality, Inequality
equals_2 = Equality(FirstNumber=tension_compresion, SecondNumber=-1)  # -> Equality, Inequality
move = Move(Geometry=end.End, Motion=amp)  # -> Geometry, Transform
move_2 = Move(Geometry=end.End, Motion=amp_2)  # -> Geometry, Transform
move_3 = Move(Geometry=end.End, Motion=amp_3)  # -> Geometry, Transform
pt_2 = Point(end.End)
ln = Line(StartPoint=end.Start, EndPoint=move.Geometry)
dispatch = Dispatch(List="1", DispatchPattern=equals.Equality)  # -> ListA, ListB
dispatch_2 = Dispatch(List="2", DispatchPattern=equals_2.Equality)  # -> ListA, ListB
col = Colour(data)
pline = PolyLine(Vertices=[pt_2, move_3.Geometry, move.Geometry, move_2.Geometry], Closed=True)
createhatch = CreateHatch(Bake=False, Curves=pline, HatchPatternName="Hatch1", HatchScale=0.01, HatchRotation=0)
preview = CustomPreview(Geometry=createhatch, Shader=col)
previewlw = CustomPreviewLineweights(Geometry=ln, Shader=col, Thickness=[dispatch.ListA, dispatch_2.ListA])
previewlw_2 = CustomPreviewLineweights(Geometry=pline, Shader=col, Thickness=1)

# ----
# SUPPORTS
node_type_2 = ValueList({"Support": "1", "Load": "2", "Float": "3", "End": "4", "Corner": "5", "Tri": "6", "Quad": "7"}, selected="Support")
pt_3 = Point(<point referenced from the Rhino model>)
tail_3 = Point(<point referenced from the Rhino model>)
tail_4 = Point(tail_3)
head_2 = Point(pt_3)
support_points_input_2 = PythonScript(Tail=tail_4, Head=head_2, Type=node_type_2)  # -> AppliedForce, Color, Node; inputs Tail: Point3d, Head: Point3d; same code as support_points_input
support_points_input_3 = PythonScript(Tail=tail_4, Head=head_2, Type=node_type_2)  # -> AppliedForce, Color, Node; inputs Tail: Point3d, Head: Point3d
# ---------- support_points_input_3: Python ----------
import rhinoscriptsyntax as rs
import ghpythonlib.components as gh
import Rhino.Geometry as rg
import Rhino as rc
import System.Drawing as sd

import Assembly as assembly
import Grammar as gr
import Rules as r
import GraphicStatics as gs

reload (assembly)
reload (gs)

################################################################################

tail = rg.Vector3d(Tail)
head = rg.Vector3d(Head)
AppliedForce = rg.Line(Tail, Head)


################################################################################

if Type == "1": #Support Point
    ThisNodeType = assembly.NodeType.Support
    ThisForceType = assembly.ForceType.Reaction
    Color = "252, 223,33" #yellow, for support reactions

if Type == "2": #Load Point
    ThisNodeType = assembly.NodeType.Load
    ThisForceType = assembly.ForceType.Applied
    Color = "0, 113, 189" #blue, for applied loads

################################################################################
# CONSTRUCT ASSEMBLY.FORCE

ForceList=[]
Force = assembly.Force(AppliedForce, ThisForceType, -1)
ForceList.append(Force)


Node = assembly.Node(Head, ThisNodeType, ForceList)

Node = gs.RearrangeForces(Node)
'''Node = gs.EquilibrateNode(Node)
print Node.Forces
################################################################################'''
# ---------- end support_points_input_3 ----------
vec2pt_2 = Vector2Pt(PointA=tail_4, PointB=head_2, Unitize=False)  # -> Vector, Length
panel = Panel([support_points_input_3.Node, vec2pt_2.Vector])
data_3 = Data(support_points_input_2.Color)
data_4 = Data(support_points_input_2.AppliedForce)
line_2 = Line(data_4)
vdisex_2 = VectorDisplayEx(Point=tail_4, Vector=data_4, Colour=data_3, Width="2")
end_2 = EndPoints(Curve=line_2)  # -> Start, End
vec2pt_3 = Vector2Pt(PointA=end_2.End, PointB=end_2.Start, Unitize=False)  # -> Vector, Length
rad_2 = Radians(Degrees="15")
rotate_3 = Rotate(Geometry=vec2pt_3.Vector, Angle=expr("x*-1", rad_2), Plane=PlaneXY(0, 0, 0))  # -> Geometry, Transform
rotate_4 = Rotate(Geometry=vec2pt_3.Vector, Angle=rad_2, Plane=PlaneXY(0, 0, 0))  # -> Geometry, Transform
tension_compresion_2 = Number("-1")
amp_4 = Amplitude(Vector=vec2pt_3.Vector, Amplitude="1")
amp_5 = Amplitude(Vector=rotate_4.Geometry, Amplitude="1.5")
amp_6 = Amplitude(Vector=rotate_3.Geometry, Amplitude="1.5")
equals_3 = Equality(FirstNumber=tension_compresion_2, SecondNumber=1)  # -> Equality, Inequality
equals_4 = Equality(FirstNumber=tension_compresion_2, SecondNumber=-1)  # -> Equality, Inequality
move_4 = Move(Geometry=end_2.End, Motion=amp_4)  # -> Geometry, Transform
move_5 = Move(Geometry=end_2.End, Motion=amp_5)  # -> Geometry, Transform
move_6 = Move(Geometry=end_2.End, Motion=amp_6)  # -> Geometry, Transform
pt_4 = Point(end_2.End)
ln_2 = Line(StartPoint=end_2.Start, EndPoint=move_4.Geometry)
dispatch_3 = Dispatch(List="1", DispatchPattern=equals_3.Equality)  # -> ListA, ListB
dispatch_4 = Dispatch(List="2", DispatchPattern=equals_4.Equality)  # -> ListA, ListB
col_2 = Colour(data_3)
pline_2 = PolyLine(Vertices=[pt_4, move_6.Geometry, move_4.Geometry, move_5.Geometry], Closed=True)
createhatch_2 = CreateHatch(Bake=False, Curves=pline_2, HatchPatternName="Hatch1", HatchScale=0.01, HatchRotation=0)
preview_2 = CustomPreview(Geometry=createhatch_2, Shader=col_2)
previewlw_3 = CustomPreviewLineweights(Geometry=ln_2, Shader=col_2, Thickness=[dispatch_3.ListA, dispatch_4.ListA])
previewlw_4 = CustomPreviewLineweights(Geometry=pline_2, Shader=col_2, Thickness=1)

node_type_3 = ValueList({"One": 1, "Two": 2, "Three": 2² - 1, "ays": 24}, selected="One")

node_type_4 = ValueList({"Support": "1", "Load": "2", "Float": "3", "End": "4", "Corner": "5", "Tri": "6", "Quad": "7"}, selected="Support")
pt_5 = Point(<point referenced from the Rhino model>)
tail_5 = Point(<point referenced from the Rhino model>)
tail_6 = Point(tail_5)
head_3 = Point(pt_5)
support_points_input_4 = PythonScript(Tail=tail_6, Head=head_3, Type=node_type_4)  # -> AppliedForce, Color, Node; inputs Tail: Point3d, Head: Point3d; same code as support_points_input
data_5 = Data(support_points_input_4.Color)
data_6 = Data(support_points_input_4.AppliedForce)
line_3 = Line(data_6)
vdisex_3 = VectorDisplayEx(Point=tail_6, Vector=data_6, Colour=data_5, Width="2")
end_3 = EndPoints(Curve=line_3)  # -> Start, End
vec2pt_4 = Vector2Pt(PointA=end_3.End, PointB=end_3.Start, Unitize=False)  # -> Vector, Length
rad_3 = Radians(Degrees="15")
rotate_5 = Rotate(Geometry=vec2pt_4.Vector, Angle=expr("x*-1", rad_3), Plane=PlaneXY(0, 0, 0))  # -> Geometry, Transform
rotate_6 = Rotate(Geometry=vec2pt_4.Vector, Angle=rad_3, Plane=PlaneXY(0, 0, 0))  # -> Geometry, Transform
tension_compresion_3 = Number("-1")
amp_7 = Amplitude(Vector=vec2pt_4.Vector, Amplitude="1")
amp_8 = Amplitude(Vector=rotate_6.Geometry, Amplitude="1.5")
amp_9 = Amplitude(Vector=rotate_5.Geometry, Amplitude="1.5")
equals_5 = Equality(FirstNumber=tension_compresion_3, SecondNumber=1)  # -> Equality, Inequality
equals_6 = Equality(FirstNumber=tension_compresion_3, SecondNumber=-1)  # -> Equality, Inequality
move_7 = Move(Geometry=end_3.End, Motion=amp_7)  # -> Geometry, Transform
move_8 = Move(Geometry=end_3.End, Motion=amp_8)  # -> Geometry, Transform
move_9 = Move(Geometry=end_3.End, Motion=amp_9)  # -> Geometry, Transform
pt_6 = Point(end_3.End)
ln_3 = Line(StartPoint=end_3.Start, EndPoint=move_7.Geometry)
dispatch_5 = Dispatch(List="1", DispatchPattern=equals_5.Equality)  # -> ListA, ListB
dispatch_6 = Dispatch(List="2", DispatchPattern=equals_6.Equality)  # -> ListA, ListB
col_3 = Colour(data_5)
pline_3 = PolyLine(Vertices=[pt_6, move_9.Geometry, move_7.Geometry, move_8.Geometry], Closed=True)
createhatch_3 = CreateHatch(Bake=False, Curves=pline_3, HatchPatternName="Hatch1", HatchScale=0.01, HatchRotation=0)
preview_3 = CustomPreview(Geometry=createhatch_3, Shader=col_3)
previewlw_5 = CustomPreviewLineweights(Geometry=ln_3, Shader=col_3, Thickness=[dispatch_5.ListA, dispatch_6.ListA])
previewlw_6 = CustomPreviewLineweights(Geometry=pline_3, Shader=col_3, Thickness=1)

dom = ConstructDomain(DomainStart=0, DomainEnd=Slider(5.7, range=0..10))
panel_2 = Panel(dom)
S_3 = Script(Tail=tail_2, Head=head, Type=node_type)  # -> out, Color, Node; inputs Tail: Point3d, Head: Point3d, Type: String
# ---------- S_3: Python ----------
# env: /Users/vishnu/Library/CloudStorage/OneDrive-PolitecnicodiMilano/Polimi_Thesis_2023/01_INCOMING/231114_Cantilever/231208/231227_Code
import importlib
import rhinoscriptsyntax as rs
import ghpythonlib.components as gh
import Rhino.Geometry as rg
import Rhino as rc
import System.Drawing as sd

import Assembly as assembly
import Grammar as gr
import Rules as r
import GraphicStatics as gs

importlib.reload (assembly)
importlib.reload (gs)

################################################################################

AppliedForce = gh.Line(Tail, Head) #GH Line Object

################################################################################
# IDENTIFY & ASSIGN

"""
Pass = 0
Support = 1
Load = 2
Float = 3
End = 4
Corner = 5
Tri = 6
Quad = 7
"""

if Type == "1": #Support Point
    ThisNodeType = assembly.NodeType.Support
    ThisForceType = assembly.ForceType.Reaction
    Color = "252, 223,33" #yellow, for support reactions

if Type == "2": #Load Point
    ThisNodeType = assembly.NodeType.Load
    ThisForceType = assembly.ForceType.Applied
    Color = "0, 113, 189" #blue, for applied loads

################################################################################
# CONSTRUCT ASSEMBLY.FORCE

ForceList=[]
Force = assembly.Force(AppliedForce, ThisForceType, -1)
ForceList.append(Force)


Node = assembly.Node(Head, ThisNodeType, ForceList)

Node = gs.RearrangeForces(Node)
Node = gs.EquilibrateNode(Node)
print (Node.Forces)
################################################################################

''' forces = Node.Forces
print(forces)

for force in forces:
    start = force.Line.PointAt(1)
    print (start) '''

transform = rg.Transform.Scale()

pt = rg.Point3d(0,0,0)
pt.Transform(transform)

print (pt)
# ---------- end S_3 ----------

# ----
# LOADS
node_type_5 = ValueList({"Support": "1", "Load": "2", "Float": "3", "End": "4", "Corner": "5", "Tri": "6", "Quad": "7"}, selected="Load")
tail_7 = Point(<point referenced from the Rhino model>)
pt_7 = Point(<point referenced from the Rhino model>)
tail_8 = Point(tail_7)
head_4 = Point(pt_7)
support_points_input_5 = PythonScript(Tail=tail_8, Head=head_4, Type=node_type_5)  # -> AppliedForce, Color, Node; inputs Tail: Point3d, Head: Point3d; same code as support_points_input
data_7 = Data(support_points_input_5.Color)
data_8 = Data(support_points_input_5.AppliedForce)
line_4 = Line(data_8)
vdisex_4 = VectorDisplayEx(Point=tail_8, Vector=data_8, Colour=data_7, Width="2")
# DE
end_4 = EndPoints(Curve=line_4)  # -> Start, End
vec2pt_5 = Vector2Pt(PointA=end_4.End, PointB=end_4.Start, Unitize=False)  # -> Vector, Length
rad_4 = Radians(Degrees="15")
rotate_7 = Rotate(Geometry=vec2pt_5.Vector, Angle=expr("x*-1", rad_4), Plane=PlaneXY(0, 0, 0))  # -> Geometry, Transform
rotate_8 = Rotate(Geometry=vec2pt_5.Vector, Angle=rad_4, Plane=PlaneXY(0, 0, 0))  # -> Geometry, Transform
tension_compresion_4 = Number("-1")
amp_10 = Amplitude(Vector=vec2pt_5.Vector, Amplitude="1")
amp_11 = Amplitude(Vector=rotate_8.Geometry, Amplitude="1.5")
amp_12 = Amplitude(Vector=rotate_7.Geometry, Amplitude="1.5")
equals_7 = Equality(FirstNumber=tension_compresion_4, SecondNumber=1)  # -> Equality, Inequality
equals_8 = Equality(FirstNumber=tension_compresion_4, SecondNumber=-1)  # -> Equality, Inequality
move_10 = Move(Geometry=end_4.End, Motion=amp_10)  # -> Geometry, Transform
move_11 = Move(Geometry=end_4.End, Motion=amp_11)  # -> Geometry, Transform
move_12 = Move(Geometry=end_4.End, Motion=amp_12)  # -> Geometry, Transform
pt_8 = Point(end_4.End)
ln_4 = Line(StartPoint=end_4.Start, EndPoint=move_10.Geometry)
dispatch_7 = Dispatch(List="1", DispatchPattern=equals_7.Equality)  # -> ListA, ListB
dispatch_8 = Dispatch(List="2", DispatchPattern=equals_8.Equality)  # -> ListA, ListB
col_4 = Colour(data_7)
pline_4 = PolyLine(Vertices=[pt_8, move_12.Geometry, move_10.Geometry, move_11.Geometry], Closed=True)
createhatch_4 = CreateHatch(Bake=False, Curves=pline_4, HatchPatternName="Hatch1", HatchScale=0.01, HatchRotation=0)
preview_4 = CustomPreview(Geometry=createhatch_4, Shader=col_4)
previewlw_7 = CustomPreviewLineweights(Geometry=ln_4, Shader=col_4, Thickness=[dispatch_7.ListA, dispatch_8.ListA])
previewlw_8 = CustomPreviewLineweights(Geometry=pline_4, Shader=col_4, Thickness=1)

# ----
# SUPPORTS
node_type_6 = ValueList({"Support": "1", "Load": "2", "Float": "3", "End": "4", "Corner": "5", "Tri": "6", "Quad": "7"}, selected="Support")
pt_9 = Point(<point referenced from the Rhino model>)
tail_9 = Point(<point referenced from the Rhino model>)
tail_10 = Point(tail_9)
head_5 = Point(pt_9)
support_points_input_6 = PythonScript(Tail=tail_10, Head=head_5, Type=node_type_6)  # -> AppliedForce, Color, Node; inputs Tail: Point3d, Head: Point3d; same code as support_points_input
support_points_input_7 = PythonScript(Tail=tail_10, Head=head_5, Type=node_type_6)  # -> AppliedForce, Color, Node; inputs Tail: Point3d, Head: Point3d; same code as support_points_input_3
vec2pt_6 = Vector2Pt(PointA=tail_10, PointB=head_5, Unitize=False)  # -> Vector, Length
panel_3 = Panel([support_points_input_7.Node, vec2pt_6.Vector])
data_9 = Data(support_points_input_6.Color)
data_10 = Data(support_points_input_6.AppliedForce)
line_5 = Line(data_10)
vdisex_5 = VectorDisplayEx(Point=tail_10, Vector=data_10, Colour=data_9, Width="2")
end_5 = EndPoints(Curve=line_5)  # -> Start, End
vec2pt_7 = Vector2Pt(PointA=end_5.End, PointB=end_5.Start, Unitize=False)  # -> Vector, Length
rad_5 = Radians(Degrees="15")
rotate_9 = Rotate(Geometry=vec2pt_7.Vector, Angle=expr("x*-1", rad_5), Plane=PlaneXY(0, 0, 0))  # -> Geometry, Transform
rotate_10 = Rotate(Geometry=vec2pt_7.Vector, Angle=rad_5, Plane=PlaneXY(0, 0, 0))  # -> Geometry, Transform
tension_compresion_5 = Number("-1")
amp_13 = Amplitude(Vector=vec2pt_7.Vector, Amplitude="1")
amp_14 = Amplitude(Vector=rotate_10.Geometry, Amplitude="1.5")
amp_15 = Amplitude(Vector=rotate_9.Geometry, Amplitude="1.5")
equals_9 = Equality(FirstNumber=tension_compresion_5, SecondNumber=1)  # -> Equality, Inequality
equals_10 = Equality(FirstNumber=tension_compresion_5, SecondNumber=-1)  # -> Equality, Inequality
move_13 = Move(Geometry=end_5.End, Motion=amp_13)  # -> Geometry, Transform
move_14 = Move(Geometry=end_5.End, Motion=amp_14)  # -> Geometry, Transform
move_15 = Move(Geometry=end_5.End, Motion=amp_15)  # -> Geometry, Transform
pt_10 = Point(end_5.End)
ln_5 = Line(StartPoint=end_5.Start, EndPoint=move_13.Geometry)
dispatch_9 = Dispatch(List="1", DispatchPattern=equals_9.Equality)  # -> ListA, ListB
dispatch_10 = Dispatch(List="2", DispatchPattern=equals_10.Equality)  # -> ListA, ListB
col_5 = Colour(data_9)
pline_5 = PolyLine(Vertices=[pt_10, move_15.Geometry, move_13.Geometry, move_14.Geometry], Closed=True)
createhatch_5 = CreateHatch(Bake=False, Curves=pline_5, HatchPatternName="Hatch1", HatchScale=0.01, HatchRotation=0)
preview_5 = CustomPreview(Geometry=createhatch_5, Shader=col_5)
previewlw_9 = CustomPreviewLineweights(Geometry=ln_5, Shader=col_5, Thickness=[dispatch_9.ListA, dispatch_10.ListA])
previewlw_10 = CustomPreviewLineweights(Geometry=pline_5, Shader=col_5, Thickness=1)

node_type_7 = ValueList({"Support": "1", "Load": "2", "Float": "3", "End": "4", "Corner": "5", "Tri": "6", "Quad": "7"}, selected="Support")
tail_11 = Point(<point referenced from the Rhino model>)
pt_11 = Point(<point referenced from the Rhino model>)
tail_12 = Point(tail_11)
head_6 = Point(pt_11)
support_points_input_8 = PythonScript(Tail=tail_12, Head=head_6, Type=node_type_7)  # -> AppliedForce, Color, Node; inputs Tail: Point3d, Head: Point3d; same code as support_points_input
data_11 = Data(support_points_input_8.Color)
data_12 = Data(support_points_input_8.AppliedForce)
line_6 = Line(data_12)
vdisex_6 = VectorDisplayEx(Point=tail_12, Vector=data_12, Colour=data_11, Width="2")
end_6 = EndPoints(Curve=line_6)  # -> Start, End
vec2pt_8 = Vector2Pt(PointA=end_6.End, PointB=end_6.Start, Unitize=False)  # -> Vector, Length
rad_6 = Radians(Degrees="15")
rotate_11 = Rotate(Geometry=vec2pt_8.Vector, Angle=expr("x*-1", rad_6), Plane=PlaneXY(0, 0, 0))  # -> Geometry, Transform
rotate_12 = Rotate(Geometry=vec2pt_8.Vector, Angle=rad_6, Plane=PlaneXY(0, 0, 0))  # -> Geometry, Transform
tension_compresion_6 = Number("-1")
amp_16 = Amplitude(Vector=vec2pt_8.Vector, Amplitude="1")
amp_17 = Amplitude(Vector=rotate_12.Geometry, Amplitude="1.5")
amp_18 = Amplitude(Vector=rotate_11.Geometry, Amplitude="1.5")
equals_11 = Equality(FirstNumber=tension_compresion_6, SecondNumber=1)  # -> Equality, Inequality
equals_12 = Equality(FirstNumber=tension_compresion_6, SecondNumber=-1)  # -> Equality, Inequality
move_16 = Move(Geometry=end_6.End, Motion=amp_16)  # -> Geometry, Transform
move_17 = Move(Geometry=end_6.End, Motion=amp_17)  # -> Geometry, Transform
move_18 = Move(Geometry=end_6.End, Motion=amp_18)  # -> Geometry, Transform
pt_12 = Point(end_6.End)
ln_6 = Line(StartPoint=end_6.Start, EndPoint=move_16.Geometry)
dispatch_11 = Dispatch(List="1", DispatchPattern=equals_11.Equality)  # -> ListA, ListB
dispatch_12 = Dispatch(List="2", DispatchPattern=equals_12.Equality)  # -> ListA, ListB
col_6 = Colour(data_11)
pline_6 = PolyLine(Vertices=[pt_12, move_18.Geometry, move_16.Geometry, move_17.Geometry], Closed=True)
createhatch_6 = CreateHatch(Bake=False, Curves=pline_6, HatchPatternName="Hatch1", HatchScale=0.01, HatchRotation=0)
preview_6 = CustomPreview(Geometry=createhatch_6, Shader=col_6)
previewlw_11 = CustomPreviewLineweights(Geometry=ln_6, Shader=col_6, Thickness=[dispatch_11.ListA, dispatch_12.ListA])
previewlw_12 = CustomPreviewLineweights(Geometry=pline_6, Shader=col_6, Thickness=1)

node_type_8 = ValueList({"Support": "1", "Load": "2", "Float": "3", "End": "4", "Corner": "5", "Tri": "6", "Quad": "7"}, selected="Support")
tail_13 = Point(<point referenced from the Rhino model>)
pt_13 = Point(<point referenced from the Rhino model>)
tail_14 = Point(tail_13)
head_7 = Point(pt_13)
support_points_input_9 = PythonScript(Tail=tail_14, Head=head_7, Type=node_type_8)  # -> AppliedForce, Color, Node; inputs Tail: Point3d, Head: Point3d; same code as support_points_input
data_13 = Data(support_points_input_9.Color)
data_14 = Data(support_points_input_9.AppliedForce)
line_7 = Line(data_14)
vdisex_7 = VectorDisplayEx(Point=tail_14, Vector=data_14, Colour=data_13, Width="2")
end_7 = EndPoints(Curve=line_7)  # -> Start, End
vec2pt_9 = Vector2Pt(PointA=end_7.End, PointB=end_7.Start, Unitize=False)  # -> Vector, Length
rad_7 = Radians(Degrees="15")
rotate_13 = Rotate(Geometry=vec2pt_9.Vector, Angle=expr("x*-1", rad_7), Plane=PlaneXY(0, 0, 0))  # -> Geometry, Transform
rotate_14 = Rotate(Geometry=vec2pt_9.Vector, Angle=rad_7, Plane=PlaneXY(0, 0, 0))  # -> Geometry, Transform
tension_compresion_7 = Number("-1")
amp_19 = Amplitude(Vector=vec2pt_9.Vector, Amplitude="1")
amp_20 = Amplitude(Vector=rotate_14.Geometry, Amplitude="1.5")
amp_21 = Amplitude(Vector=rotate_13.Geometry, Amplitude="1.5")
equals_13 = Equality(FirstNumber=tension_compresion_7, SecondNumber=1)  # -> Equality, Inequality
equals_14 = Equality(FirstNumber=tension_compresion_7, SecondNumber=-1)  # -> Equality, Inequality
move_19 = Move(Geometry=end_7.End, Motion=amp_19)  # -> Geometry, Transform
move_20 = Move(Geometry=end_7.End, Motion=amp_20)  # -> Geometry, Transform
move_21 = Move(Geometry=end_7.End, Motion=amp_21)  # -> Geometry, Transform
pt_14 = Point(end_7.End)
ln_7 = Line(StartPoint=end_7.Start, EndPoint=move_19.Geometry)
dispatch_13 = Dispatch(List="1", DispatchPattern=equals_13.Equality)  # -> ListA, ListB
dispatch_14 = Dispatch(List="2", DispatchPattern=equals_14.Equality)  # -> ListA, ListB
col_7 = Colour(data_13)
pline_7 = PolyLine(Vertices=[pt_14, move_21.Geometry, move_19.Geometry, move_20.Geometry], Closed=True)
createhatch_7 = CreateHatch(Bake=False, Curves=pline_7, HatchPatternName="Hatch1", HatchScale=0.01, HatchRotation=0)
preview_7 = CustomPreview(Geometry=createhatch_7, Shader=col_7)
previewlw_13 = CustomPreviewLineweights(Geometry=ln_7, Shader=col_7, Thickness=[dispatch_13.ListA, dispatch_14.ListA])
previewlw_14 = CustomPreviewLineweights(Geometry=pline_7, Shader=col_7, Thickness=1)

# ----
# BOUNDARY
crv_2 = Curve(<curve referenced from the Rhino model>)
data_15 = Data(crv_2)

data_16 = Data(support_points_input.Node)
data_17 = Data([support_points_input_2.Node, support_points_input_4.Node])

# ----
# BOUNDARY
crv_3 = Curve(<curve referenced from the Rhino model>)
data_18 = Data(crv_3)

data_19 = Data(support_points_input_5.Node)
data_20 = Data([support_points_input_6.Node, support_points_input_8.Node, support_points_input_9.Node])
S_4 = Script()  # -> out, a; unedited script template
makeassembly = MakeAssembly(loads=data_16, supports=data_17, boundary=data_15)
S_5 = Script(x=makeassembly)  # -> out, a
# ---------- S_5: Python ----------
import rhinoscriptsyntax as rs
import ghpythonlib.components as ghcomp
import Rhino.Geometry as rg
import Rhino as rc

import System.Drawing as sd


################################################################################
#  IMPORT JUNEY FILES

import Assembly as assembly
import Grammar as gr
import Rules

g = gr.Grammar()
r = gr.RandomComputation(g)

shape = r.GenerateRandomAssembly(StartShape)
# ---------- end S_5 ----------

python = GhPythonScript(Switch=Toggle(False))  # -> out, a; inputs Switch: Boolean
# ---------- python: Python ----------
__author__ = "vishnu"

import rhinoscriptsyntax as rs

import Grasshopper as gh
from System.Drawing import Color

if Switch:
    #reset colorsettings canvas background,grid, shade and edge
    gh.GUI.Canvas.GH_Skin.canvas_back = Color.White
    gh.GUI.Canvas.GH_Skin.canvas_grid = Color.White
else:
    gh.GUI.Canvas.GH_Skin.canvas_back = Color.FromArgb(255, 212, 208, 200); 
    gh.GUI.Canvas.GH_Skin.canvas_grid = Color.FromArgb(30, 0, 0, 0)
#set colorsettings canvas background,grid, shade and edge
# ---------- end python ----------

makeassembly_2 = MakeAssembly(loads=data_19, supports=data_20, boundary=data_18)
assembly = Data(makeassembly)
qla_instance = GhPythonScript(StartShape=assembly)  # -> out, Environment, Agent
# ---------- qla_instance: Python ----------
import rhinoscriptsyntax as rs
import ghpythonlib.components as gh
import Rhino.Geometry as rg
import System.Drawing as sd
import math
import random
import copy

################################################################################
#  IMPORT JUNEY FILES
################################################################################
import Assembly as assembly
import Grammar as gr
import Rhino as rc
import Rules as rules
import GraphicStatics as gs

import RandomUtility as ru

import QLA_231127 as qa

reload (assembly)
reload (gs)
reload (rules)
reload (gr)


reload (qa)

################################################################################
#  IMPORT RHINOREMOTE
################################################################################

import scriptcontext
import ghpythonremote
np = scriptcontext.sticky['numpy']
rpy = scriptcontext.sticky['rpy']


################################################################################
#  Instantiate ML classes
################################################################################

mygrammar = gr.Grammar()
randcomp = gr.RandomComputation(mygrammar)


env = qa.Environment(mygrammar, randcomp, StartShape)

agent = qa.QLearningAgent(randcomp, env)

# Test code here


# Output
Environment = env
Agent = agent
# ---------- end qla_instance ----------
data_21 = Data(makeassembly)
qla_start = GhPythonScript(env=qla_instance.Environment, agent=qla_instance.Agent)  # -> out, Environment, Agent
# ---------- qla_start: Python ----------
import rhinoscriptsyntax as rs
import ghpythonlib.components as gh
import Rhino.Geometry as rg
import System.Drawing as sd
import math
import random

################################################################################
#  IMPORT JUNEY FILES
################################################################################
import Assembly as assembly
import Grammar as gr
import Rhino as rc
import Rules as rules
import GraphicStatics as gs

import RandomUtility as ru

import QLA_231127 as qa

reload (assembly)
reload (gs)
reload (rules)
reload (gr)


reload (qa)

################################################################################
#  IMPORT RHINOREMOTE
################################################################################

import scriptcontext
import ghpythonremote
np = scriptcontext.sticky['numpy']
rpy = scriptcontext.sticky['rpy']

import ghpythonlib.treehelpers as th

################################################################################
#  Code for ML 
################################################################################
env.reset()

a = [n.Coordinate for n in env.assembly.Nodes]
################################################################################
#  Output
################################################################################

Environment = env
Agent = agent
# ---------- end qla_start ----------
qla_instance_2 = GhPythonScript(StartShape=data_21)  # -> out, Environment, Agent; same code as qla_instance
S_6 = Script(x=data_21)  # -> out, a
# ---------- S_6: Python ----------
# env: /Users/vishnu/Library/Application Support/McNeel/Rhinoceros/Scripts

import Assembly as assembly
# ---------- end S_6 ----------
qla_train_loop = GhPythonScript(episodes="100", env=qla_start.Environment, agent=qla_start.Agent, target_length="100")  # -> out, state, assembly, done, action, applicablerules, active_nodes, members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; inputs episodes: Int32, target_length: Int32
# ---------- qla_train_loop: Python ----------
import rhinoscriptsyntax as rs
import ghpythonlib.components as gh
import Rhino.Geometry as rg
import System.Drawing as sd
import math
import random
import copy

################################################################################
#  IMPORT JUNEY FILES
################################################################################
import Assembly as assembly
import Grammar as gr
import Rhino as rc
import Rules as rules
import GraphicStatics as gs

import RandomUtility as ru

import QLA_231127 as qa

reload (assembly)
reload (gs)
reload (rules)
reload (gr)


reload (qa)

################################################################################
#  IMPORT RHINOREMOTE
################################################################################

import scriptcontext
import ghpythonremote
np = scriptcontext.sticky['numpy']
rpy = scriptcontext.sticky['rpy']


import ghpythonlib.treehelpers as th

################################################################################
#  Code for ML 
################################################################################

scriptcontext.sticky['assembly_list'] = []
scriptcontext.sticky['assembly_length'] = []

env.input_length = target_length

agent.train(episodes)


################################################################################
#  Output
################################################################################
'''rules = []
for rule in state:
    rules.append(rule[0])
 
print len(state)
applicablerules = rules'''

"""q_table_df = pd.DataFrame(agent.q_table)
print (q_table_df)"""

assemblies = scriptcontext.sticky['assembly_list']
length = scriptcontext.sticky['assembly_length']

activenodes = gs.GetActiveNodes(env.assembly)
active_nodes=[]
for node in activenodes:
    #force = gs.GetTempForce(node)[0]
    active_nodes.append(node.Coordinate)

assembly = env.assembly
done = env.is_done()
active_nodes
members = env.assembly.Members
history = env.assembly.History.Rules

Environment = env
Agent = agent
#rewards = agent.episode_rewards
# ---------- end qla_train_loop ----------
qla_start_2 = GhPythonScript(env=qla_instance_2.Environment, agent=qla_instance_2.Agent)  # -> out, Environment, Agent, a; same code as qla_start

# ---- group: Use numpy, click to open and run
python_2 = PythonScript()  # -> out, a
# ---------- python_2: Python ----------
import scriptcontext
import ghpythonremote
np = scriptcontext.sticky['numpy']
rpy = scriptcontext.sticky['rpy']

# Do some numpy stuff
a = np.arange(20).reshape(4, 5)
print(a)
print(np.linalg.eig(np.arange(9).reshape(3, 3)))

# Fast way of sending data for numpy array creation
remote_range = ghpythonremote.deliver(rpy, range(1000))
array = np.array(remote_range)
# This is much slower
#b = np.array(range(1000))

# Get the array back as a local IronPython list
list = ghpythonremote.obtain(array.tolist())

# Get an error
#np.arange(9).reshape(4,3)
# ---------- end python_2 ----------
panel_4 = Panel(python_2.out)

# ----
data_22 = Data(qla_start_2.a)

python_3 = GhPythonScript(x=Button(), comp_name="MakeAssembly")  # -> out, a; inputs x: Boolean
# ---------- python_3: Python ----------
__author__ = "vishnu"

import rhinoscriptsyntax as rs

if x:

    for obj in ghenv.Component.OnPingDocument().Objects:
        if obj.NickName == comp_name:
            obj.ExpireSolution(True)
# ---------- end python_3 ----------

qla_start_3 = GhPythonScript(env=qla_start_2.Environment, agent=qla_start_2.Agent)  # -> out, Environment, Agent, assembly, a
# ---------- qla_start_3: Python ----------
import rhinoscriptsyntax as rs
import ghpythonlib.components as gh
import Rhino.Geometry as rg
import System.Drawing as sd
import math
import random

################################################################################
#  IMPORT JUNEY FILES
################################################################################
import Assembly as assembly
import Grammar as gr
import Rhino as rc
import Rules as rules
import GraphicStatics as gs

import RandomUtility as ru

import QLA_231125 as qa

reload (assembly)
reload (gs)
reload (rules)
reload (gr)


reload (qa)

################################################################################
#  IMPORT RHINOREMOTE
################################################################################

import scriptcontext
import ghpythonremote
np = scriptcontext.sticky['numpy']
rpy = scriptcontext.sticky['rpy']


import ghpythonlib.treehelpers as th

################################################################################
#  Code for ML 
################################################################################

env.reset()
assembly = env.assembly
env.start()

state = env.get_state()
action = agent.select_action(state)
step, reward, done = env.step(action)
next_state = env.get_state()

agent.update(state, action, reward, next_state)



lists = []
for s in state:
    lists.append("{x}{y}".format(x=s[0], y=s[2]))
stup = (tuple(lists))


action_key = (action[0], action[-1])

print action_key
# ---------- end qla_start_3 ----------
design = GhPythonScript()  # -> out, designs
# ---------- design: Python ----------
__author__ = "vishnu"

import rhinoscriptsyntax as rs

designs = []
for i in range(3):
    designs.append(i)
# ---------- end design ----------
loop = GhPythonScript(episodes="100", env=qla_start_2.Environment, agent=qla_start_2.Agent, target_length="100", designs=design.designs)  # -> out, state, assembly, done, action, applicablerules, active_nodes, members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; inputs episodes: Int32, target_length: Int32, designs: list; same code as qla_train_loop
python_4 = GhPythonScript()  # -> out, assemby_Nodes
# ---------- python_4: Python ----------
__author__ = "vishnu"

import rhinoscriptsyntax as rs
import scriptcontext

assemblies = scriptcontext.sticky['initial_assembly'].Nodes
# ---------- end python_4 ----------
number_slider = Slider(10, range=0..10)
number_slider_2 = Slider(41, range=0..100)
loop_2 = GhPythonScript(env=qla_start_2.Environment, agent=qla_start_2.Agent, designs=design.designs)  # -> out, state, assembly, done, action, applicablerules, active_nodes, members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; inputs designs: list; disabled
# ---------- loop_2: Python ----------
import rhinoscriptsyntax as rs
import ghpythonlib.components as gh
import Rhino.Geometry as rg
import System.Drawing as sd
import math
import random
import copy

################################################################################
#  IMPORT JUNEY FILES
################################################################################
import Assembly as assembly
import Grammar as gr
import Rhino as rc
import Rules as rules
import GraphicStatics as gs

import RandomUtility as ru

import QLA_231125 as qa

reload (assembly)
reload (gs)
reload (rules)
reload (gr)


reload (qa)

################################################################################
#  IMPORT RHINOREMOTE
################################################################################

import scriptcontext
import ghpythonremote
np = scriptcontext.sticky['numpy']
rpy = scriptcontext.sticky['rpy']
pd = scriptcontext.sticky['pandas']

import ghpythonlib.treehelpers as th

################################################################################
#  Code for ML 
################################################################################

scriptcontext.sticky['assembly_list'] = []
episodes = 100

for episode in range(episodes):
    if 'assembly_list' not in scriptcontext.sticky:
        scriptcontext.sticky['assembly_list'] = []
    env.reset()
    env.start()
    i = 0
    while not env.is_done():
        break_while = False
        state = env.get_state() # returns possible node rules
        lists = []
        for s in state:
            lists.append("{x}{y}".format(x=state[0], y=state[2]))
        stup = (tuple(lists))
        
        action = agent.select_action(state)
        lista = []
        lista.append("{l}{m}".format(l=action[0], m=action[2]))
        actup = (tuple(lista))
        
        
        step = env.step(action) # returns and assembly
        if stup not in agent.q_table:
            agent.q_table[stup] = {}

        if actup not in agent.q_table[stup]:
            agent.q_table[stup][actup] = i  # or any default value

        
        state = env.get_state()
        
        
        for node in agent.environment.assembly.Nodes:
            if gh.PointInCurve(node.Coordinate, agent.environment.boundary)[0] == 0: #if node is outside the boundary ideally give a neg reward 
                break_while = True
                break
                
        if break_while:
            break
        if env.is_done() or i>40:
            env.done()
            scriptcontext.sticky['assembly_list'].append(env.assembly)
            state = env.get_state()
            i=0
            
            break
        i+=1  
    print designs


'''state = env.get_state()
action = agent.select_action(state)
step = env.step(action)
state = env.get_state()'''


################################################################################
#  Output
################################################################################
'''rules = []
for rule in state:
    rules.append(rule[0])
 
print len(state)
applicablerules = rules'''

"""q_table_df = pd.DataFrame(agent.q_table)
print (q_table_df)"""

assemblies = scriptcontext.sticky['assembly_list']

activenodes = gs.GetActiveNodes(env.assembly)
active_nodes=[]
for node in activenodes:
    #force = gs.GetTempForce(node)[0]
    active_nodes.append(node.Coordinate)
    
    
assembly = env.assembly
done = env.is_done()
active_nodes
members = env.assembly.Members
history = env.assembly.History.Rules

Environment = env
Agent = agent
# ---------- end loop_2 ----------
crvprox = CurveProximity()  # -> PointA, PointB, Distance
panel_5 = Panel(python_4.assemby_Nodes)
panel_6 = Panel(loop.length)
panel_7 = Panel(loop.rewards)
results = GhPythonScript(env=loop_2.Environment, agent=loop_2.Agent)  # -> out, Environment, Agent, results, tempforces
# ---------- results: Python ----------
import rhinoscriptsyntax as rs
import ghpythonlib.components as gh
import Rhino.Geometry as rg
import System.Drawing as sd
import math
import random

################################################################################
#  IMPORT JUNEY FILES
################################################################################
import Assembly as assembly
import Grammar as gr
import Rhino as rc
import Rules as rules
import GraphicStatics as gs

import RandomUtility as ru

#import QLA_231120 as qa

reload (assembly)
reload (gs)
reload (rules)
reload (gr)


#reload (qa)

################################################################################
#  IMPORT RHINOREMOTE
################################################################################

import scriptcontext
import ghpythonremote
np = scriptcontext.sticky['numpy']
rpy = scriptcontext.sticky['rpy']

import ghpythonlib.treehelpers as th

################################################################################
#  Code for ML 
################################################################################
results = env.designs

print results
################################################################################
#  Output
################################################################################
activenodes = gs.GetActiveNodes(env.assembly)
active_nodes=[]
tempforces = []
for node in activenodes:
    active_nodes.append(node.Coordinate)
    forcelist = node.Forces
    for force in forcelist:
        if force.Type == 3:
            tempforces.append(force.Line)
        
        
    
Environment = env
Agent = agent
# ---------- end results ----------
pt_15 = Point(loop_2.active_nodes)
crv_4 = Curve(loop_2.members)

# ---- group: OPN2
data_23 = Data("Grasshopper.Kernel.Types.GH_ObjectWrapper")

# ----
item = ListItem(List=qla_train_loop.assemblies, Index=Slider(0, range=0..15), Wrap=True)
panel_8 = Panel(loop_2.state)
panel_9 = Panel(loop_2.done)
panel_10 = Panel(loop_2.action)
panel_11 = Panel(loop_2.history)
panel_12 = Panel(loop_2.assemblies)
data_24 = Data(results.results)
data_25 = Data(results.tempforces)
lng = ListLength(List=loop.assemblies)
data_26 = Data(qla_start_3.assembly)
python_5 = GhPythonScript(x=data_26)  # -> out, a
# ---------- python_5: Python ----------
__author__ = "vishnu"

import rhinoscriptsyntax as rs
import scriptcontext

scriptcontext.sticky['assembly_list'] = []

#a = scriptcontext.sticky['assembly_list']
list = []

length = x.GetLength()

list.append(x.MyState)
list .append(length)

a = list
# ---------- end python_5 ----------
panel_13 = Panel(lng)
overlap = GhPythonScript(x=data_26)  # -> out, a
# ---------- overlap: Python ----------
import rhinoscriptsyntax as rs
import ghpythonlib.components as gh
import Rhino.Geometry as rg
import System.Drawing as sd
import math
import random

################################################################################
#  IMPORT JUNEY FILES
################################################################################
import Assembly as assembly
import Grammar as gr
import Rhino as rc
import Rules as rules
import GraphicStatics as gs

import RandomUtility as ru

import QLA_231125 as qa

reload (assembly)
reload (gs)
reload (rules)
reload (gr)


reload (qa)

################################################################################
#  IMPORT RHINOREMOTE
################################################################################

import scriptcontext
import ghpythonremote
np = scriptcontext.sticky['numpy']
rpy = scriptcontext.sticky['rpy']
pd = scriptcontext.sticky['pandas']

import ghpythonlib.treehelpers as th

################################################################################
#  Code for ML 
################################################################################
intersections = []
for member in x.Members:
    node = gs.GetMemberNodes(member, x)
    
    member_pts = []
    for n in node:
        member_pts.append(n.Coordinate)
        
    for other_member in x.Members:
        if member != other_member:  # Avoid self-comparison
            other_nodes = gs.GetMemberNodes(other_member, x)
            other_pts = []
            for o in other_nodes:
                other_pts.append(o.Coordinate)
            cp = gh.CurveXCurve(member, other_member)[0]
            
            if cp == member_pts[0] or cp == member_pts[1]: 
                pass
            else:
                #ip = gh.CurveXCurve(member, other_member)[0]
                #if cp == ip:
                intersections.append(cp)

a = intersections
# ---------- end overlap ----------
panel_14 = Panel(python_5.a)
item_2 = ListItem(List=results.results, Index=Slider(2, range=0..10), Wrap=True)
start = GhPythonScript(EndShape=item_2)  # -> out, Environment, Agent, results, members
# ---------- start: Python ----------
import rhinoscriptsyntax as rs
import ghpythonlib.components as gh
import Rhino.Geometry as rg
import System.Drawing as sd
import math
import random

################################################################################
#  IMPORT JUNEY FILES
################################################################################
import Assembly as assembly
import Grammar as gr
import Rhino as rc
import Rules as rules
import GraphicStatics as gs

import RandomUtility as ru

#import QLA_231120 as qa

reload (assembly)
reload (gs)
reload (rules)
reload (gr)


#reload (qa)

################################################################################
#  IMPORT RHINOREMOTE
################################################################################

import scriptcontext
import ghpythonremote
np = scriptcontext.sticky['numpy']
rpy = scriptcontext.sticky['rpy']

import ghpythonlib.treehelpers as th

################################################################################
#  Code for ML 
################################################################################

################################################################################
#  Output
################################################################################

mambers = EndShape.Members
# ---------- end start ----------
crv_5 = Curve(start.members)
panel_15 = Panel(crv_5)

test = GhPythonScript(env=loop_2.Environment, agent=loop_2.Agent)  # -> out, assembly, done, action, applicablerules, active_nodes, members, history; disabled
# ---------- test: Python ----------
import rhinoscriptsyntax as rs
import ghpythonlib.components as gh
import Rhino.Geometry as rg
import System.Drawing as sd
import math
import random

################################################################################
#  IMPORT JUNEY FILES
################################################################################
import Assembly as assembly
import Grammar as gr
import Rhino as rc
import Rules as rules
import GraphicStatics as gs

import RandomUtility as ru

#import QLA_231120 as qa

reload (assembly)
reload (gs)
reload (rules)
reload (gr)


#reload (qa)

################################################################################
#  IMPORT RHINOREMOTE
################################################################################

import scriptcontext
import ghpythonremote
np = scriptcontext.sticky['numpy']
rpy = scriptcontext.sticky['rpy']

import ghpythonlib.treehelpers as th

################################################################################
#  Code for ML 
################################################################################
env.reset()

'''i = 0
state = env.get_state() # returns possible node rules

while not env.is_done():
    
    action = agent.select_action(state)
    step = env.step(action) # returns and assembly
    state = env.get_state()
     
    if i > 100:
        env.done()
        state = env.get_state()
        i=0'''
   
        
        
'''state = env.get_state()
action = agent.select_action(state)
step = env.step(action)
state = env.get_state() '''


################################################################################
#  Output
################################################################################
'''rules = []
for rule in state:
    rules.append(rule[0])'''
 

applicablerules = rules

activenodes = gs.GetActiveNodes(env.assembly)
active_nodes=[]
for node in activenodes:
    active_nodes.append(node.Coordinate)
    
    
assembly = env.assembly
done = env.is_done()
active_nodes
members = env.assembly.Members
history = env.assembly.History.Rules
# ---------- end test ----------
data_27 = Data(test.active_nodes)
panel_16 = Panel(test.out)

# ---- group: Assembly
data_28 = Data(data_26)

# ----
pipeline = GeometryPipeline(
    GroupByLayer=False,
    GroupByType=False,
    IncludeHidden=True,
    IncludeLocked=True,
    LayerFilter="Linework",
    NameFilter="*",
    SublayerFiltering=True,
    TypeFilter=4)  # disabled
pipeline_2 = GeometryPipeline(
    GroupByLayer=False,
    GroupByType=False,
    IncludeHidden=True,
    IncludeLocked=True,
    LayerFilter="Design::Points",
    NameFilter="*",
    SublayerFiltering=True,
    TypeFilter=1)  # disabled
boolean_toggle = BooleanToggle(True)
panel_17 = Panel(pipeline)  # disabled
number_slider_3 = Slider(0, range=0..3)  # disabled
crv_6 = Curve([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])  # disabled
panel_18 = Panel("0.5")  # disabled
end_8 = EndPoints(Curve=crv_6)  # -> Start, End; disabled
dispatch_15 = Dispatch(List=data_28, DispatchPattern=Toggle(False))  # -> ListA, ListB
dispatch_16 = Dispatch(List=data_28, DispatchPattern=Toggle(False))  # -> ListA, ListB
Z = UnitZ(Factor=1)  # disabled
number_slider_4 = Slider(6, range=0..10)  # disabled

data_29 = Data([Line((-318.0119949, -157.6290834, 0), (-323.3338662, -159.3302146, 0)), Line((-318.0119949, -157.6290834, 0), (-323.4335397, -155.369928, 0)), Line((-318.0119949, -162.0048299, 0), (-323.4678311, -163.2213907, 0)), Line((-318.0119949, -162.0048299, 0), (-323.6388897, -159.7019413, 0)), Line((-323.4335397, -155.369928, 0), (-328.1136503, -153.419728, 0)), Line((-328.1136503, -152.727109, 0), (-328.1136503, -153.419728, 0))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])

# ----
# Rules
dispatch_17 = Dispatch(List=data_28, DispatchPattern=Toggle(False))  # -> ListA, ListB
python_script = PythonScript(Assembly=dispatch_17.ListB)  # -> pt, ptlist, history, indexlist, colorlist, historywithindex
# ---------- python_script: Python ----------
import rhinoscriptsyntax as rs
import ghpythonlib.components as gh
import Rhino.Geometry as rg
import System.Drawing as sd
import math
import random

import Assembly as assembly
import Grammar as gr
import Rhino as rc
import Rules as rules
import GraphicStatics as gs

reload (assembly)
reload (gs)
reload (rules)
reload (gr)


#boundary points
nodecount = len(Assembly.Nodes)
boundary = Assembly.Boundary
boundarypts = gh.DeconstructBrep(boundary)[2]

colors = [
"219, 107,4",
"225, 212,0",
"140, 198, 63",
"58, 178, 221",
"0, 105, 151",
"216, 75, 141",
"146, 10, 120"]

"""
0. Orange = "219, 107,4"

1. Yellow = "225, 212,0"
2. Green = "140, 198, 63"
3. Sky = "58, 178, 221"
4. Blue = "0, 105, 151"
5. Magenta = "216, 75, 141"

6. Purple = "146, 10, 120"
"""

################################################################################
x = []
y = []
for pt in boundarypts:
    x.append(pt.X)
    y.append(pt.Y)

x = gh.SortList(x)[0]
y = gh.SortList(y)[0]

pt = rg.Point3d(x[-1]+10, y[-1], 0)
pt1 = rg.Point3d(x[-1]+10, y[-1]-3, 0)

################################################################################

history = []
for t in Assembly.History.Rules:
    b = t[2].Name, 'applied at Node', t[0]
    history.append(b)

print history[-1]
################################################################################

ptlist = []
ptlist.append(pt1)

vector = gh.UnitY(-1.5)
for i in range(0,len(history)-1):
    mpt = gh.Move(ptlist[-1], vector)[0]
    ptlist.append(mpt)

################################################################################

colorlist = []
for i in range(0,len(history)):
    if history[i][0] == "Rule 0: 'START'":
        colorlist.append(colors[0]) #0. Orange = 219, 107,4

    elif history[i][0] == "Rule 1: 'Create Node'":
        colorlist.append(colors[1]) #1. Yellow = 225, 212,0

    elif history[i][0] == "Rule 2: 'Extend Node'":
        colorlist.append(colors[2]) #2. Green = 140, 198, 63

    elif history[i][0] == "Rule 3: 'Split Node'":
        colorlist.append(colors[3]) #3. Sky = 58, 178, 221

    elif history[i][0] == "Rule 4: 'Connect with Element'":
        colorlist.append(colors[4]) #4. Blue = 0, 105, 151

    elif history[i][0] == "Rule 5: 'Connect via Projection'":
        colorlist.append(colors[5]) #5. Magenta = 216, 75, 141

    if history[i][0] == "Rule 7: 'System Close'" or history[i][0] == "Rule 8: 'END'":
        colorlist.append(colors[6]) #6. Purple = 146, 10, 120



################################################################################

indexlist = []
historywithindex = []
for i in range(0,len(history)):
    indexlist.append((i+1,'.'))
    c = (indexlist[i], history[i])
    historywithindex.append(c)
# ---------- end python_script ----------
rep = ReplaceText(Text=flatten(python_script.historywithindex), Find="(", RecursiveReplace=False)
rep_2 = ReplaceText(Text=flatten(rep), Find=")", RecursiveReplace=False)
rep_3 = ReplaceText(Text=flatten(rep_2), Find="'", RecursiveReplace=False)
rep_4 = ReplaceText(Text=flatten(rep_3), Find=",", RecursiveReplace=False)
swatch = ColourSwatch(SwatchColor=RGB(66, 66, 66))
tag = TextTag3D(
    Location=python_script.pt,
    Text="RULE HISTORY",
    Size=1.5,
    Colour=ColourSwatch(SwatchColor=RGB(102, 102, 102)),
    Justification=1)
tag_2 = TextTag3D(Location=python_script.ptlist, Text=rep_4, Size=0.75, Colour=python_script.colorlist, Justification=1)

pt_16 = Point(end_8.Start)  # disabled
number_slider_5 = Slider(3.56, range=0..10)  # disabled
number_slider_6 = Slider(3, range=0..10)  # disabled
number_slider_7 = Slider(0.463, range=0..10)  # disabled
pdecon = Deconstruct(Point=pt_16)  # -> XComponent, YComponent, ZComponent; disabled

# ---- group: DISPLAY TEMP FORCES
python_script_2 = PythonScript(Assembly=dispatch_15.ListA)  # -> a, NodeTempForces, TempForceLines
# ---------- python_script_2: Python ----------
import rhinoscriptsyntax as rs
import ghpythonlib.components as gh
import Rhino.Geometry as rg
import System.Drawing as sd
import math
import random

import Assembly as assembly
import Grammar as gr
import Rhino as rc
import Rules as r
import GraphicStatics as gs

reload (assembly)
reload (gs)
reload (r)


nodes = []
for node in Assembly.Nodes:
    nodes.append(node.Coordinate)


TempForceLines = []
for node in Assembly.Nodes: # for every node
    for i in range(0,len(node.Forces)): #for every force at node
        if node.Forces[i].Type == 3: #if the force is a temporary force
            TempForceLines.append(node.Forces[i].Line)

print TempForceLines
# ---------- end python_script_2 ----------

# ----
multiplication = Multiplication(A=number_slider_4, B=3.28)  # disabled
crv_7 = Curve([<curve referenced from the Rhino model> x14])
sort = SortList(Keys=pdecon.YComponent, ValuesA=pt_16)  # -> Keys, ValuesA; disabled
Y = UnitY(Factor=multiplication)  # disabled
multiplication_2 = Multiplication(A=number_slider_5, B=3.28)  # disabled
multiplication_3 = Multiplication(A=number_slider_7, B=3.28)  # disabled
item_3 = ListItem(List=sort.ValuesA, Index=0, Wrap=True)  # disabled
neg = Negative(Value=Y)  # disabled
X = UnitX(Factor=multiplication_2)  # disabled
Z_2 = UnitZ(Factor=multiplication_3)  # disabled
neg_2 = Negative(Value=X)  # disabled

python_script_3 = PythonScript(Assembly=dispatch_16.ListB, startyoffset=Slider(-15, range=-20..-5))  # -> out, boundarypts, gridofpts, polygons, colors, ReactionForceLines, AppliedForceLines, TempForceLines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
# ---------- python_script_3: Python ----------
import rhinoscriptsyntax as rs
import ghpythonlib.components as gh
import Rhino.Geometry as rg
import System.Drawing as sd
import math
import random

import Assembly as assembly
import Grammar as gr
import Rhino as rc
import Rules as rules
import GraphicStatics as gs

reload (assembly)
reload (gs)
reload (rules)
reload (gr)


#boundary points
nodecount = len(Assembly.Nodes)
boundary = Assembly.Boundary
boundarypts = gh.DeconstructBrep(boundary)[2]


################################################################################
x = []
y = []
for pt in boundarypts:
    x.append(pt.X)
    y.append(pt.Y)

x = gh.SortList(x)[0]
y = gh.SortList(y)[0]

xrange = x[-1]-x[0]
xmid = xrange/2
startx = x[0]
starty = startyoffset

xcount = 5
xspacing = xrange/xcount
ycount = int(math.ceil(nodecount/xcount))
yspacing = -10

################################################################################
gridofpts = []

firstrowpts = []
for i in range(0,xcount+1):
    pt = rg.Point3d(xspacing*i, starty, 0)
    firstrowpts.append(pt)
gridofpts.append(firstrowpts)

if ycount > 1:
    for i in range(0,ycount-1):
        translation = gh.Vector2Pt(rg.Point3d(0,0,0), rg.Point3d(0,yspacing,0))[0]
        nextrow = gh.Move(gridofpts[-1], translation)[0]
        gridofpts.append(nextrow)
else:
    pass
gridofpts  = [val for sublist in gridofpts for val in sublist]


del gridofpts[nodecount:]



################################################################################
#Force Polygon
polygons = []
for i in range(0,len(Assembly.Nodes)):
    d = gs.DrawNodeForcePolygon(Assembly.Nodes[i], rg.Point3d(gridofpts[i]))
    polygons.append(d)


ReactionForceLines = []
for forcelist in polygons: # for every node
    for force in forcelist: #for every force at node
        if force.Type == 1: #if the force is a temporary force
            ReactionForceLines.append(force.Line)

AppliedForceLines = []
for forcelist in polygons: # for every node
    for force in forcelist: #for every force at node
        if force.Type == 2: #if the force is a temporary force
            AppliedForceLines.append(force.Line)

TempForceLines = []
for forcelist in polygons: # for every node
    for force in forcelist: #for every force at node
        if force.Type == 3: #if the force is a temporary force
            TempForceLines.append(force.Line)

MemberForceLines = []
for forcelist in polygons: # for every node
    for force in forcelist: #for every force at node
        if force.Type == 4: #if the force is a temporary force
            MemberForceLines.append(force.Line)

CompressionMembers =[]
TensionMembers = []
for forcelist in polygons: # for every node
    for force in forcelist: #for every force at node
        if force.Type == 4: #if the force is a temporary force
            if force.Direction == -1:
                CompressionMembers.append(force.Line)
            else:
                TensionMembers.append(force.Line)



################################################################################



colors = ["219, 107,4", "225, 212,0", "140, 198, 63", "58, 178, 221", "0, 105, 151", "216, 75, 141", "146, 10, 120"]
"""
Orange = "219, 107,4"
Yellow = "225, 212,0"
Green = "140, 198, 63"
Sky = "58, 178, 221"
Blue = "0, 105, 151"
Magenta = "216, 75, 141"
Purple = "146, 10, 120"
"""
# ---------- end python_script_3 ----------
python_script_4 = PythonScript(x=python_script_3.polygons)  # -> a, list; inputs x: list
# ---------- python_script_4: Python ----------
import collections
from Grasshopper import DataTree
from Grasshopper.Kernel.Data import GH_Path


def unpackList(nestedlist):
    dataTree = DataTree[object]()
    for i, item_list in enumerate(nestedlist):
        path = GH_Path(i)
        dataTree.AddRange(item_list, path)
    return dataTree

a = unpackList(x) 













"""
def unpackList(lst):
    tree = DataTree[object]()
    
    for elem in lst:
        path=GH_Path(0)
        if isinstance(elem, collections.Iterable):
            tree.MergeTree(unpackList(elem,path.AppendElement(0)))
        else:
            print(path)
            #tree.Add(elem)
            #tree.Add(elem,path)
            tree.Add(elem,path)
        path = path.Increment(-1)
    return tree

a = unpackList(x) 


list = []
for i in range(0,len(x)):
    a = unpackList(x[i]) 
    list.append(a)
"""
# ---------- end python_script_4 ----------

neg_3 = Negative(Value=Z_2)  # disabled
move_22 = Move(Geometry=item_3, Motion=neg)  # -> Geometry, Transform; disabled

# ---- group: Display Temp Forces
cluster = Cluster(line=python_script_2.TempForceLines)

# ----
move_23 = Move(Geometry=move_22.Geometry, Motion=neg_2)  # -> Geometry, Transform; disabled

# ---- group: 2D Planae
number_slider_8 = Slider(105, range=0..500)
pt_17 = Point(<point referenced from the Rhino model>)
pt_18 = Point(<point referenced from the Rhino model>)
pt_19 = Point(<point referenced from the Rhino model>)
pt_20 = Point(<point referenced from the Rhino model>)
vec2pt_10 = Vector2Pt(PointA=pt_17, PointB=pt_18, Unitize=False)  # -> Vector, Length
vec2pt_11 = Vector2Pt(PointA=pt_19, PointB=pt_20, Unitize=False)  # -> Vector, Length
amp_22 = Amplitude(Vector=vec2pt_11.Vector, Amplitude=number_slider_8)
amp_23 = Amplitude(Vector=vec2pt_10.Vector, Amplitude=number_slider_8)
loads = LoadsKaramba3D(ForceVector=amp_23, Local=False, PosInd=pt_18, LCase="0", mode="Point")
loads_2 = LoadsKaramba3D(ForceVector=amp_22, Local=False, PosInd=pt_20, LCase="0", mode="Point")
load = LoadKaramba3D(loads)

# ----
crv_8 = Curve(python_script_3.TensionMembers)

# ---- group: FORM DIAGRAM - VISUAL SCALE
number_slider_9 = Slider(1.5, range=0.1..5)

# ---- group: LINEWEIGHT
number_slider_10 = Slider(1, range=1..10)

# ----
data_30 = Data(python_script_3.boundarypts)
merge = Merge(Data1=move_22.Geometry, Data2=item_3, Data3=move_23.Geometry)  # disabled
Y_2 = UnitY(Factor=Slider(3.87, range=0..10))
pline_8 = PolyLine(Vertices=merge, Closed=False)  # disabled

# ---- group: 2D Planae
pt_21 = Point([<point referenced from the Rhino model> x2])
pt_22 = Point(<point referenced from the Rhino model>)
supp = SupportKaramba3D(PosInd=pt_21, menu=[buttons(on, off, off, off, off, off)])
supp_2 = SupportKaramba3D(PosInd=pt_22, menu=[buttons(on, on, on, on, on, on)])
support = SupportKaramba3D([supp, supp_2])

# ----
crv_9 = Curve([<curve referenced from the Rhino model> x2])  # disabled
move_24 = Move(Geometry=python_script.pt, Motion=Y_2)  # -> Geometry, Transform
merge_2 = Merge(Data1=crv_9, Data2=crv_6)  # disabled
group = Group(Objects=merge_2)  # disabled
xy = XYPlane(Origin=Point(-344.2587141, -185.5355079, 0))  # disabled

number_slider_11 = Slider(-5, range=-5..0)
X_2 = UnitX(Factor=number_slider_11)
move_25 = Move(Geometry=python_script_3.gridofpts, Motion=X_2)  # -> Geometry, Transform
Y_3 = UnitY(Factor=number_slider_11)
move_26 = Move(Geometry=python_script_3.gridofpts, Motion=Y_3)  # -> Geometry, Transform
index = ItemIndex(List=move_26.Geometry, Item=move_26.Geometry)
tag_3 = TextTag3D(
    Location=move_26.Geometry,
    Text=index,
    Size=Slider(1, range=1..5),
    Colour=ColourSwatch(SwatchColor=RGB(191, 191, 191)),
    Justification=7)

force_display = ForceDisplay_2(
    line=graft(python_script_3.AppliedForceLines),
    force_type="1",
    tension_compresion="-1",
    colour=ColourSwatch(SwatchColor=RGB(0, 113, 189)))

force_display_2 = ForceDisplay_2(
    line=graft(python_script_3.TempForceLines),
    force_type="1",
    tension_compresion="-1",
    colour=ColourSwatch(SwatchColor=RGB(200, 6, 38)))

force_display_3 = ForceDisplay_2(
    line=graft(python_script_3.ReactionForceLines),
    force_type="1",
    tension_compresion="-1",
    colour=ColourSwatch(SwatchColor=RGB(252, 223, 33)))

# ---- group: Supprt
crv_10 = Curve([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])

# ----
number_slider_12 = Slider(0.2, range=0..1)  # disabled

# ---- group: Compression
force_display_4 = ForceDisplay_2(
    line=graft(python_script_3.CompressionMembers),
    force_type="1",
    tension_compresion="-1",
    colour=ColourSwatch(SwatchColor=RGB(33, 33, 33)))

# ---- group: Tension
force_display_5 = ForceDisplay_2(
    line=graft(python_script_3.TensionMembers),
    force_type="1",
    tension_compresion="1",
    colour=ColourSwatch(SwatchColor=RGB(143, 143, 143)))

# ---- group: Display Reaction Forces
cluster_2 = Cluster_2()

# ----
swatch_2 = ColourSwatch(SwatchColor=RGB(89, 70, 70))  # disabled
Z_3 = UnitZ(Factor=Slider(100, range=0..100))
neg_4 = Negative(Value=Z_3)
loads_3 = LoadsKaramba3D(Vector=Vector(0, 0, -1), LCase="0", mode="Gravity")

# ---- group: Import remote python modules
panel_19 = Panel("""numpy
scipy
numpy.linalg""")
# GH to python remote example.
# ⓒ Pierre Cuvilliers, 2017-2022
# Released under the MIT license
# github.com/pilcru/ghpythonremote
# Runs and connects to an external python engine, and
# assigns imported modules to scriptcontext.sticky variables.
# 
# Arguments:
#       code (str): Path to the GH_to_python.py code file.
#       location (str): Path to a python executable, or to a folder
#             containing `python.exe`, or the name of a conda-created
#             virtual environment prefixed by `conda://` (`conda://env_name`).
#             If empty, finds python from your windows %PATH%.
#       run (boolean): Creates the connection, and imports new
#             modules, when turned to True. Kills the connection,
#             and deletes the references to the imports, when turned
#             to False.
#       modules (str list): List of module names to import in the
#             remote python. They will be added to the
#             scriptcontext.sticky dictionary, allowing them to be
#             reused from other python components in the same
#             Grasshopper document. Submodules (for example
#             `numpy.linalg`) have to be added explicitly to this list
#             to be available later, and importing the parent package is
#             also required even if only the submodule is used.
#       log_level (str from ['NOTSET', 'DEBUG', 'INFO', 'WARNING', 'ERROR', 'CRITICAL']):
#             Logging level to use for the local IronPython and the
#             remote python instance.
#       working_dir (str): Working directory for the remote python
#             instance.
# 
# Returns:
#       out (str): Console output with DEBUG information.
#       linked_modules (str list): list of imported module names.
#       rpy (rpyc connection object): The object representing the remote Python interpreter.
panel_20 = Panel("conda://rhinoremote")

# ----
# Turn me on!   -->
python_6 = PythonScript()  # -> rhino_doc_dir
# ---------- python_6: Python ----------
import scriptcontext as sc
from os import path

rhino_doc_dir = path.abspath(path.dirname(sc.doc.Path))
# ---------- end python_6 ----------
list = ValueList({"CRITICAL", "ERROR", "WARNING", "INFO", "DEBUG", "NOTSET"}, selected="DEBUG")

# ---- group: Import remote python modules (continued)
panel_21 = Panel(python_6)
ghpythonremote = GHPythonRemote(location=panel_20, run=Toggle(True), modules=panel_19, log_level=list, working_dir=panel_21)  # -> out, linked_modules, rpy; inputs run: Boolean, modules: list
# ---------- ghpythonremote: Python ----------
import inspect
import logging
from os import path
import sys
from time import sleep

import scriptcontext

import ghpythonremote
from ghpythonremote.connectors import GrasshopperToPythonRemote
from Grasshopper.Kernel.GH_RuntimeMessageLevel import Error, Warning

local_log_level = getattr(logging, log_level, logging.WARNING)
logger = logging.getLogger("ghpythonremote")
logger.setLevel(local_log_level)
ch = logging.StreamHandler()
ch.setLevel(local_log_level)
formatter = logging.Formatter("%(levelname)s: %(name)s:\n%(message)s")
ch.setFormatter(formatter)
logger.handlers = []
logger.addHandler(ch)
logger = logging.getLogger("ghpythonremote.GH_to_python")

ROOT = path.abspath(path.dirname(inspect.getfile(ghpythonremote)))
rpyc_server_py = path.join(ROOT, "pythonservice.py")

cluster_comp = ghenv.Component.OnPingDocument().Owner

# Set connection to CLOSED if this is the first run
# and initialize set of linked modules
try:
    remote_python_status
except NameError:
    remote_python_status = "CLOSED"
    lkd_modules = set()

# Wait for connection to connect or terminate
timer = 0
while remote_python_status == "CONNECTING" or remote_python_status == "CLOSING":
    sleep(1)
    timer += 1
    if timer == 10:
        try:
            gh2py_manager.__exit__(*sys.exc_info())
        except Exception:
            pass
        remote_python_status = "CLOSED"
        lkd_modules = set()
        message = (
            "Connection left in an inconsistent state and not returning. Reset "
            "everything."
        )
        if cluster_comp is not None:
            cluster_comp.AddRuntimeMessage(Warning, message)
        raise RuntimeError(message)

if run:
    if not remote_python_status == "OPEN":
        remote_python_status = "CONNECTING"
        gh2py_manager = GrasshopperToPythonRemote(
            rpyc_server_py,
            location=location,
            timeout=10,
            port=None,
            log_level=log_level,
            working_dir=working_dir,
        )
        gh2py = gh2py_manager.__enter__()
        remote_python_status = "OPEN"

    # Stuff that we can reach
    rpymod = gh2py.py_remote_modules  # A getter function for a named python module
    rpy = gh2py.connection  # Represents the remote instance root object
    scriptcontext.sticky["rpy"] = rpy
    # Add modules
    for mod in modules:
        try:
            scriptcontext.sticky[mod] = rpymod(mod)
            lkd_modules.add(mod)
        except ImportError:
            gh2py_manager.__exit__(*sys.exc_info())
            if cluster_comp is not None:
                cluster_comp.AddRuntimeMessage(
                    Error,
                    'Could not import module "{}" in remote Python.'.format(mod)
                )
            raise
        except EOFError:
            if cluster_comp is not None:
                cluster_comp.AddRuntimeMessage(
                    Error,
                    'Remote Python has been closed unexpectedly'
                )
            raise

elif not remote_python_status == "CLOSED":
    remote_python_status = "CLOSING"
    # Remove linked modules
    for mod in lkd_modules:
        del scriptcontext.sticky[mod]
    del scriptcontext.sticky["rpy"]
    gh2py_manager.__exit__(*sys.exc_info())
    lkd_modules = set()
    remote_python_status = "CLOSED"

# Change variable name because ghpython resets outputs to None before each run
linked_modules = lkd_modules

logger.info("GH to python connection is {}".format(remote_python_status))
# ---------- end ghpythonremote ----------
panel_22 = Panel(ghpythonremote.out)

# ----
python_7 = PythonScript(module_names=ghpythonremote.linked_modules)  # -> import_statements; inputs module_names: list
# ---------- python_7: Python ----------
import_statements = ["import scriptcontext as sc"]
for module_name in module_names:
    import_statements.append("{0} = sc.sticky['{0}']".format(module_name))

if len(module_names) == 0:
    import_statements = []
# ---------- end python_7 ----------
panel_23 = Panel(python_7)

# ----
# Support display
boolean_toggle_2 = BooleanToggle(True)
dispatch_18 = Dispatch(List=data_28, DispatchPattern=boolean_toggle_2)  # -> ListA, ListB
X_3 = UnitX(Factor=1)
crv_11 = Curve([<curve referenced from the Rhino model> x5])
xy_2 = XYPlane(Origin=Point(3.954860175, 0, 0))
group_2 = Group(Objects=crv_11)
group_3 = Group(Objects=crv_10)
xy_3 = XYPlane(Origin=Point(0, 0, 0))
panel_24 = Panel("1.25")

python_script_5 = PythonScript(Assembly=dispatch_18.ListA)  # -> a, b
# ---------- python_script_5: Python ----------
import rhinoscriptsyntax as rs
import ghpythonlib.components as gh
import Rhino.Geometry as rg
import System.Drawing as sd
import math
import random

import Assembly as assembly
import Grammar as gr
import Rhino as rc
import Rules as r
import GraphicStatics as gs

reload (assembly)
reload (gs)
reload (r)

a=[]
b=[]

for i in range(0,len(Assembly.Nodes)):
    if Assembly.Nodes[i].Type == 1:
        a.append(Assembly.Nodes[i].Coordinate)
        for force in Assembly.Nodes[i].Forces:
            if force.Type == 1:
                b.append(force.Line)
# ---------- end python_script_5 ----------

data_31 = Data(python_script_5.b)
end_9 = EndPoints(Curve=data_31)  # -> Start, End
vec2pt_12 = Vector2Pt(PointA=end_9.Start, PointB=end_9.End, Unitize=False)  # -> Vector, Length
xy_4 = XYPlane(Origin=python_script_5.a)
dprod = DotProduct(VectorA=vec2pt_12.Vector, VectorB=X_3, Unitize=False)
rotate_15 = Rotate(Geometry=xy_4, Angle=-1.570796327, Plane=xy_4)  # -> Geometry, Transform
larger = LargerThan(FirstNumber=dprod, SecondNumber=0)  # -> LargerThan, OrEqualTo
dispatch_19 = Dispatch(List=rotate_15.Geometry, DispatchPattern=larger.LargerThan)  # -> ListA, ListB
pflip = FlipPlane(Plane=dispatch_19.ListB, ReverseX=False, ReverseY=True, SwapAxes=False)
merge_3 = Merge(Data1=dispatch_19.ListA, Data2=pflip)
pin_support = PINSUPPORT(
    support_location=graft(python_script_5.a),
    color=ColourSwatch(SwatchColor=RGB(0, 0, 0)),
    lineweight_scale=number_slider_10,
    visual_scale=number_slider_9)
orient = Orient(Geometry=group_2, Source=xy_2, Target=merge_3)  # -> Geometry, Transform
orient_2 = Orient(Geometry=group_3, Source=xy_3, Target=merge_3)  # -> Geometry, Transform
item_4 = ListItem(List=orient.Geometry, Wrap=True)
cull_i = CullIndex(List=orient_2.Geometry, Wrap=True)
ungroup = Ungroup(Group=item_4)
ungroup_2 = Ungroup(Group=orient_2.Geometry)
item_5 = ListItem(List=ungroup, Index=0, Wrap=True)  # -> Item, Item1, Item2, Item3, Item4
item_6 = ListItem(List=ungroup_2, Index=0, Wrap=True)  # -> Item, Item1, Item2
crv_12 = Curve([item_5.Item, item_5.Item1, item_5.Item2])
crv_13 = Curve(item_5.Item4)
crv_14 = Curve(item_5.Item3)
crv_15 = Curve(item_6.Item2)
crv_16 = Curve(item_6.Item1)
crv_17 = Curve(item_6.Item)
entwine = Entwine(Branch00=crv_12, Branch01=crv_17, FlattenInputs=True)
entwine_2 = Entwine(Branch00=crv_14, Branch01=crv_16, FlattenInputs=True)
entwine_3 = Entwine(Branch00=crv_13, Branch01=crv_15, FlattenInputs=True)
createhatch_8 = CreateHatch(Bake=False, Curves=entwine_3, HatchPatternName="Hatch1", HatchScale=Slider(1.28, range=0..10), HatchRotation="45")  # -> HatchGeometry, HatchObjects
previewlw_15 = CustomPreviewLineweights(Geometry=entwine, Shader=ColourSwatch(SwatchColor=RGB(0, 0, 0)), Thickness=".025", Absolute=True)
previewlw_16 = CustomPreviewLineweights(Geometry=entwine_2, Shader=ColourSwatch(SwatchColor=RGB(0, 0, 0)), Thickness=".05", Absolute=True)

previewlw_17 = CustomPreviewLineweights(Geometry=createhatch_8.HatchGeometry, Shader=ColourSwatch(SwatchColor=RGB(0, 0, 0)), Thickness=".05", Absolute=True)

python_script_6 = PythonScript(Assembly=data_28)  # -> a, nodetypes, nodestate
# ---------- python_script_6: Python ----------
import rhinoscriptsyntax as rs
import ghpythonlib.components as gh
import Rhino.Geometry as rg
import System.Drawing as sd
import math
import random

import Assembly as assembly
import Grammar as gr
import Rhino as rc
import Rules as r
import GraphicStatics as gs

reload (assembly)
reload (gs)
reload (r)



a=[]
nodetypes =[]
nodestate =[]
for i in range(0,len(Assembly.Nodes)):
    a.append(Assembly.Nodes[i].Coordinate)
    nodetypes.append(Assembly.Nodes[i].Type)
    nodestate.append(Assembly.Nodes[i].NodeState)
# ---------- end python_script_6 ----------
swatch_3 = ColourSwatch(SwatchColor=RGB(255, 255, 255))

dispatch_20 = Dispatch(List=python_script_6.a, DispatchPattern=Toggle(True))  # -> ListA, ListB
swatch_4 = ColourSwatch(SwatchColor=RGB(0, 0, 0))

cir = Circle(Plane=dispatch_20.ListA, Radius=Slider(0.15, range=0..1))
createhatch_9 = CreateHatch(Bake=False, Curves=cir, HatchPatternName="Solid", HatchScale=1, HatchRotation=0)
preview_8 = CustomPreview(Geometry=createhatch_9, Shader=swatch_4)
previewlw_18 = CustomPreviewLineweights(Geometry=cir, Shader=swatch_4, Thickness=Slider(6, range=0..20))

pt_23 = Point(python_script_6.a)
number_slider_13 = Slider(0.4, range=0..1)
dispatch_21 = Dispatch(List=pt_23, DispatchPattern=Toggle(True))  # -> ListA, ListB
python_script_7 = PythonScript(x=dispatch_21.ListA, y=Slider(1.4, range=0..2))  # -> out, a; inputs x: list
# ---------- python_script_7: Python ----------
listlength = len(x)

a = []
for i in range(0, listlength):
    if i > 9:
        a.append(y+0.8)
    else:
        a.append(y)

print a
# ---------- end python_script_7 ----------
python_script_8 = PythonScript(x=dispatch_21.ListA, y=Slider(1.4, range=0..4))  # -> out, a; inputs x: list; same code as python_script_7
X_4 = UnitX(Factor=number_slider_13)
X_5 = UnitX(Factor=python_script_7.a)
X_6 = UnitX(Factor=python_script_8.a)
move_27 = Move(Geometry=dispatch_21.ListA, Motion=X_4)  # -> Geometry, Transform
Y_4 = UnitY(Factor=number_slider_13)
move_28 = Move(Geometry=dispatch_21.ListA, Motion=X_5)  # -> Geometry, Transform
move_29 = Move(Geometry=dispatch_21.ListA, Motion=X_6)  # -> Geometry, Transform
Y_5 = UnitY(Factor=Slider(1.03, range=0..2))
Y_6 = UnitY(Factor=Slider(0.4, range=0..1))
move_30 = Move(Geometry=move_27.Geometry, Motion=Y_4)  # -> Geometry, Transform
move_31 = Move(Geometry=move_28.Geometry, Motion=Y_5)  # -> Geometry, Transform
move_32 = Move(Geometry=move_29.Geometry, Motion=Y_6)  # -> Geometry, Transform
index_2 = ItemIndex(List=move_30.Geometry, Item=move_30.Geometry)
swatch_5 = ColourSwatch(SwatchColor=RGB(18, 97, 110))
swatch_6 = ColourSwatch(SwatchColor=RGB(119, 0, 138))
concat = Concatenate(FragmentA="Type:", FragmentB=python_script_6.nodetypes)
concat_2 = Concatenate(FragmentA="State:", FragmentB=python_script_6.nodestate)
# Node
tag_4 = TextTag3D(
    Location=move_30.Geometry,
    Text=index_2,
    Size=Slider(1, range=1..5),
    Colour=ColourSwatch(SwatchColor=RGB(0, 0, 0)),
    Justification=7)
tag_5 = TextTag3D(
    Location=move_31.Geometry,
    Text=concat,
    Size=Slider(0.35, range=0.1..2),
    Colour=ColourSwatch(SwatchColor=RGB(0, 137, 158)),
    Justification=7)
tag_6 = TextTag3D(
    Location=move_32.Geometry,
    Text=concat_2,
    Size=Slider(0.35, range=0.1..2),
    Colour=ColourSwatch(SwatchColor=RGB(137, 64, 148)),
    Justification=7)

number_slider_14 = Slider(1, range=0..3)  # disabled
crv_18 = Curve(<curve referenced from the Rhino model>)  # disabled
explode = Explode(Curve=crv_18, Recursive=True)  # -> Segments, Vertices; disabled
number_slider_15 = Slider(8, range=0..10)  # disabled
item_7 = ListItem(List=explode.Segments, Index=number_slider_14, Wrap=True)  # disabled
divide = DivideCurve(Curve=item_7, Count=number_slider_15, Kinks=False)  # -> Points, Tangents, Parameters; disabled
Z_4 = UnitZ(Factor=1)  # disabled

crv_cp = CurveClosestPoint(Point=pipeline_2, Curve=item_7)  # -> Point, Parameter, Distance; disabled
item_8 = ListItem(List=explode.Segments, Index=number_slider_3, Wrap=True)  # disabled
eval = EvaluateCurve(Curve=item_7, Parameter=crv_cp.Parameter)  # -> Point, Tangent, Angle; disabled
eval_2 = EvaluateCurve(Curve=reparameterize(item_8), Parameter=panel_18)  # -> Point, Tangent, Angle; disabled
xprod = CrossProduct(VectorA=eval_2.Tangent, VectorB=Z, Unitize=False)  # -> Vector, Length; disabled
pl = ConstructPlane(Origin=eval_2.Point, XAxis=xprod.Vector, YAxis=Z)  # disabled

# ----
# Members
python_8 = GhPythonScript(Assembly=data_28)  # -> out, members, memberforceamplitude, memberforcetype, memberforcelines, thickness, test
# ---------- python_8: Python ----------
import rhinoscriptsyntax as rs
import ghpythonlib.components as gh
import Rhino.Geometry as rg
import System.Drawing as sd
import math
import random
import Rhino as rh


import Assembly as assembly
import Grammar as gr
import Rhino as rc
import Rules as r
import GraphicStatics as gs

reload (assembly)
reload (gs)
reload (r)

members =[]

memberforcelines = []
memberforceamplitude = []
memberforcetype = []
test = []

for member in Assembly.Members:
    members.append(member)
    
    membervector = gs.LineToVector(member)[0]
    
    node = gs.GetMemberNodes(member, Assembly)[0]
    test.append(node.Coordinate)
    for force in node.Forces:
        #print "node index,", GetNodeIndex(node, assembly)
        if force.Type == 4:
            memberforcelines.append(force.Line)
            
            vector = gs.LineToVector(force.Line)[0]
            crossproduct = gh.CrossProduct(membervector, vector)[1]
            
            if crossproduct < 0.001 :
                print crossproduct
                amplitude = gh.VectorLength(vector)
                memberforceamplitude.append(amplitude)

                direction = force.Direction
                memberforcetype.append(direction)
    
    
    
    

thickness = []
for type in memberforcetype:
    if type == -1:
        thickness.append(5)
    else:
        thickness.append(1)
        
'''for node in Assembly.Nodes:
    for force in node.Forces:
        if force.Type == 4:
            line = force.Line
            start = gh.EndPoints(line)[0]
            end = gh.EndPoints(line)[1]
            
            vector = gh.Vector2Pt(start, end)
            #vector = gs.LineToVector(force.Line)[0]
            memberforcetype.append(vector)'''
# ---------- end python_8 ----------
dispatch_22 = Dispatch(List=python_8.members, DispatchPattern=Toggle(True))  # -> ListA, ListB
len = Length(Curve=python_8.members)
multiplication_4 = Multiplication(A=flatten(len), B=flatten(python_8.memberforceamplitude))

# ---- group: 2D Planae
line_8 = Line(simplify(python_8.members))
crv_19 = Curve(crv_7)
crosecrselect = CrossSectionRangeSelectorKaramba3D(MaximumHeight_cm=-1, MaximumWidth_cm=-1, menu=[dropdown(1), dropdown(3), dropdown(1)])
explode_2 = Explode(Curve=crv_19, Recursive=True)  # -> Segments, Vertices
llinter = LineLineIntersectionKaramba3D(Line=explode_2.Segments, LimitDistance_m=0.005)  # -> IntersectionPoints, flatten(LineSubSegements)
item_9 = ListItem(List=crosecrselect, Index=0, Wrap=True)
linetobeam = LineToBeamKaramba3D(
    Line=llinter.LineSubSegements,
    CrossSection=item_9,
    New=True,
    Remove=True,
    LimitDistance_m=0.005,
    Bending=True,
    SetBucklingLength=True,
    ToPolylineMaxAngle=0.03,
    ToPolylineTolerance=0.01,
    ToPolylineMaxEdgeLength=0.25)  # -> Element, Points, Info
assemble = AssembleModelKaramba3D(Elem=linetobeam.Element, Support=support, Load=load, LimitDistance_m=0.005)  # -> Model, Info, Mass_kg, CenterOfGravity, LoadCaseNames
opticrosec = OptimizeCrossSectionKaramba3D(
    Model=assemble.Model,
    CrossSections=crosecrselect,
    MaximumUtilization=1,
    UltimateLimitStateIterations=5,
    DisplacementIterations=5,
    NumberOfSamplePoints=3,
    ElasticDesign=True,
    GammaM0=1,
    GammaM1=1.1,
    SwayFrame=True)  # -> ModelWithOptimizedCrossSections, Info, Mass_kg, MaximumDisplacement_cm, ElasticEnergyChange_kNm
modelview = ModelViewKaramba3D(Model=opticrosec.ModelWithOptimizedCrossSections, ResultFactors=1, ResultCase=-1)  # -> Model, DeformedMesh, DeformedAxes, DeformedModel
beamview = BeamViewKaramba3D(Model=modelview.Model)  # -> Model, MeshesOfRenderedBeams, DeformedBeamAxes, LegendColors, LegendTags

# ---- group: Force Amplitude
num = Number(simplify(python_8.memberforceamplitude))

# ---- group: Force Type
int = Integer(python_8.memberforcetype)

# ----
line_9 = Line(simplify(python_8.members))
dispatch_23 = Dispatch(List=line_9, DispatchPattern=boolean_toggle)  # -> ListA, ListB
line_10 = Line(simplify(dispatch_23.ListA))
division = Division(A=num, B=Slider(20, range=1..20))
multiplication_5 = Multiplication(A=division, B=-1)
offset = Offset(Curve=line_10, Distance=division, Plane=PlaneXY(0, 0, 0), Corners=1)
offset_2 = Offset(Curve=line_10, Distance=multiplication_5, Plane=PlaneXY(0, 0, 0), Corners=1)
loft = Loft(
    Curves=[offset, offset_2],
    Options={Adjust=False, Closed=False, LoftEnds=0, LoftSimp=0, LoftType=0, Rebuild=10, Refit=0.01})  # -> simplify(Loft)
multiplication_6 = Multiplication(A=num, B=int)  # -> flatten(Result)
edges = BrepEdges(Brep=loft)  # -> simplify(Naked), Interior, NonManifold
panel_25 = Panel(multiplication_6)
join = JoinCurves(Curves=edges.Naked, Preserve=False)
larger_2 = LargerThan(FirstNumber=panel_25, SecondNumber="0")  # -> LargerThan, OrEqualTo
dispatch_24 = Dispatch(List=panel_25, DispatchPattern=larger_2.LargerThan)  # -> ListA, ListB
dispatch_25 = Dispatch(List=flatten(loft), DispatchPattern=larger_2.LargerThan)  # -> ListA, ListB
dispatch_26 = Dispatch(List=flatten(loft), DispatchPattern=larger_2.LargerThan)  # -> ListA, ListB

# ---- group: Force Amplitude
num_2 = Number(simplify(python_8.memberforceamplitude))

# ---- group: Force Type
int_2 = Integer(python_8.memberforcetype)

# ----
line_11 = Line(simplify(python_8.members))
dispatch_27 = Dispatch(List=line_11, DispatchPattern=boolean_toggle)  # -> ListA, ListB
line_12 = Line(simplify(dispatch_27.ListA))
division_2 = Division(A=num_2, B=Slider(20, range=1..20))
multiplication_7 = Multiplication(A=division_2, B=-1)
offset_3 = Offset(Curve=line_12, Distance=division_2, Plane=PlaneXY(0, 0, 0), Corners=1)
offset_4 = Offset(Curve=line_12, Distance=multiplication_7, Plane=PlaneXY(0, 0, 0), Corners=1)
loft_2 = Loft(
    Curves=[offset_3, offset_4],
    Options={Adjust=False, Closed=False, LoftEnds=0, LoftSimp=0, LoftType=0, Rebuild=10, Refit=0.01})  # -> simplify(Loft)
multiplication_8 = Multiplication(A=num_2, B=int_2)  # -> flatten(Result)
edges_2 = BrepEdges(Brep=loft_2)  # -> simplify(Naked), Interior, NonManifold
panel_26 = Panel(multiplication_8)
join_2 = JoinCurves(Curves=edges_2.Naked, Preserve=False)
larger_3 = LargerThan(FirstNumber=panel_26, SecondNumber="0")  # -> LargerThan, OrEqualTo
dispatch_28 = Dispatch(List=panel_26, DispatchPattern=larger_3.LargerThan)  # -> ListA, ListB
dispatch_29 = Dispatch(List=flatten(loft_2), DispatchPattern=larger_3.LargerThan)  # -> ListA, ListB
dispatch_30 = Dispatch(List=flatten(loft_2), DispatchPattern=larger_3.LargerThan)  # -> ListA, ListB
swatch_7 = ColourSwatch(SwatchColor=RGBA(255, 0, 0, 75))
swatch_8 = ColourSwatch(SwatchColor=RGBA(0, 0, 255, 50))

offset_5 = Offset(Curve=python_8.members, Distance=0.4, Plane=PlaneXY(0, 0, 0), Corners=1)
divide_2 = DivideCurve(Curve=offset_5, Count=2, Kinks=False)  # -> Points, Tangents, Parameters
swatch_9 = ColourSwatch(SwatchColor=RGB(0, 0, 0))
item_10 = ListItem(List=divide_2.Points, Index=1, Wrap=True)  # -> simplify(flatten(Item))
index_3 = ItemIndex(List=dispatch_22.ListA, Item=dispatch_22.ListA)
tag_7 = TextTag3D(Location=item_10, Text=index_3, Size=0.4, Colour=swatch_9, Justification=5)

# ---- group: Node Hatch
number_slider_16 = Slider(0.15, range=0..1)
end_10 = EndPoints(Curve=python_8.members)  # -> Start, End
cir_2 = Circle(Plane=end_10.Start, Radius=number_slider_16)
cir_3 = Circle(Plane=end_10.End, Radius=number_slider_16)
createhatch_10 = CreateHatch(Bake=False, Curves=[cir_2, cir_3], HatchPatternName="Solid", HatchScale=1, HatchRotation=0)
preview_9 = CustomPreview(Geometry=createhatch_10, Shader=ColourSwatch(SwatchColor=RGB(0, 0, 0)))

# ----
ma = MassAddition(Input=multiplication_4)  # -> Result, PartialResults
pt_24 = Point(<point referenced from the Rhino model>)
eval_3 = Evaluate(F="Round(number, decimals)", number=ma.Result, decimals=Slider(2, range=0..10))
concat_3 = Concatenate(FragmentA="ΣFL = ", FragmentB=eval_3)
tag_8 = TextTag3D(Location=move_24.Geometry, Text=concat_3, Size=1.5, Colour=swatch_9, Justification=4)

swatch_10 = ColourSwatch(SwatchColor=RGB(0, 0, 0))
previewlw_19 = CustomPreviewLineweights(Geometry=[cir_2, cir_3], Shader=swatch_10, Thickness=expr("6", 1))
previewlw_20 = CustomPreviewLineweights(Geometry=dispatch_22.ListA, Shader=swatch_10, Thickness=python_8.thickness)

panel_27 = Panel(eval_3)
python_script_9 = PythonScript(x=eval_3, currentshape=data_28)  # -> out, a
# ---------- python_script_9: Python ----------
currentshape.Score = x
# ---------- end python_script_9 ----------

bnd = Bounds(Numbers=dispatch_24.ListB)
dedomain = DeconstructDomain(Domain=bnd)  # -> Start, End
gradient = Gradient(LowerLimit=dedomain.Start, UpperLimit="0", Parameter=dispatch_24.ListB, stops=[0: RGB(0, 0, 255), 1: RGB(0, 0, 255)])
simplebake = CSharpScript(obj=[dispatch_25.ListB, dispatch_26.ListB], layer="Compression", color=gradient)  # -> out; inputs obj: GeometryBase, name: String, layer: String, color: Color, activate: Boolean
# ---------- simplebake: C# ----------
    //Inserts geometry into the Rhino document, with custom attributes
    //Written by Giulio Piacentino - rewritten by [uto] for GH 07
    //Version written 2010 09 27 - for Grasshopper 0.7.0055

    if(obj == null) return;
    if(activate){

      //Make new attribute
      Rhino.DocObjects.ObjectAttributes att = new Rhino.DocObjects.ObjectAttributes();
      Guid o_id = default(Guid);

      //Set object name
      if(name != null && Rhino.DocObjects.Layer.IsValidName(name) == true)
      {
        att.Name = name;
      }

      //Set layer
      if(layer != null && Rhino.DocObjects.Layer.IsValidName(layer) == true){
        //Get the current layer index

        Rhino.DocObjects.Tables.LayerTable layerTable = doc.Layers;
        int layerIndex = layerTable.Find(layer, true);
        if(layerIndex == -1){ //This layer does not exist, we add it
          //make new layer
          Rhino.DocObjects.Layer myLayer = new Rhino.DocObjects.Layer();
          myLayer.Name = layer;
          //Add the layer to the layer table
          layerIndex = layerTable.Add(myLayer);

          if( layerIndex > -1 ){ //We manged to add layer!
            att.LayerIndex = layerIndex;
            __out.Add("Added new layer to the document at position " + layerIndex + " named " + layer + ". ");
          }else{
            __out.Add("Layer did not add. Try cleaning up your layers."); //This never happened to me.
          }
        }else{
          att.LayerIndex = layerIndex;
          __out.Add("Added to existing layer " + layerIndex + " named " + layer + ". ");
        }
      }

      //Set color
      if(color != null)
      {
        att.ColorSource = Rhino.DocObjects.ObjectColorSource.ColorFromObject;
        att.ObjectColor = color;
        att.PlotColorSource = Rhino.DocObjects.ObjectPlotColorSource.PlotColorFromObject;
        att.PlotColor = color;
      }

      //Bake to the right type of object
      switch (obj.ObjectType)
      {
        case Rhino.DocObjects.ObjectType.Brep:
          o_id = doc.Objects.AddBrep((Brep) obj, att);
          break;
        case Rhino.DocObjects.ObjectType.Mesh:
          o_id = doc.Objects.AddMesh((Mesh) obj, att);
          break;

        case Rhino.DocObjects.ObjectType.Point:
          o_id = doc.Objects.AddPoint(((Rhino.Geometry.Point) obj).Location, att);
          break;

        case Rhino.DocObjects.ObjectType.Curve:
          o_id = doc.Objects.AddCurve((Curve) obj, att);
          break;

        default:
          Print("I'm not sure what kind of geometry is coming in the input. Try turning it into a Point, Curve, Mesh, or Brep before the input.");
          return;
      }
      __out.Add("Added " + obj.GetType().Name);

    } else {

      Print("Inactive");
    }
# ---------- end simplebake ----------
preview_10 = CustomPreview(Geometry=[dispatch_25.ListB, dispatch_26.ListB], Shader=ColourSwatch(SwatchColor=RGBA(0, 0, 255, 50)))
panel_28 = Panel(simplebake)

bnd_2 = Bounds(Numbers=dispatch_28.ListB)
dedomain_2 = DeconstructDomain(Domain=bnd_2)  # -> Start, End
gradient_2 = Gradient(LowerLimit=dedomain_2.Start, UpperLimit="0", Parameter=dispatch_28.ListB, stops=[0: RGB(0, 0, 255), 1: RGB(0, 0, 255)])
panel_29 = Panel("Compression")

gradient_3 = Gradient(LowerLimit=1, UpperLimit=1, Parameter=dispatch_24.ListA, stops=[0: RGB(255, 0, 0), 1: RGB(255, 0, 0)])
simplebake_2 = CSharpScript(obj=[dispatch_25.ListA, dispatch_26.ListA], layer="Tension", color=gradient_3)  # -> out; inputs obj: GeometryBase, name: String, layer: String, color: Color, activate: Boolean; same code as simplebake
preview_11 = CustomPreview(Geometry=[dispatch_25.ListA, dispatch_26.ListA], Shader=ColourSwatch(SwatchColor=RGBA(255, 0, 0, 75)))
panel_30 = Panel(simplebake_2)

gradient_4 = Gradient(LowerLimit=1, UpperLimit=1, Parameter=dispatch_28.ListA, stops=[0: RGB(255, 0, 0), 1: RGB(255, 0, 0)])
panel_31 = Panel("Tension")

preview_12 = CustomPreview(
    Geometry=[dispatch_29.ListA, dispatch_30.ListA, dispatch_29.ListB, dispatch_30.ListB],
    Shader=ColourSwatch(SwatchColor=RGB(0, 0, 0)))

xprod_2 = CrossProduct(VectorA=eval.Tangent, VectorB=Z_4, Unitize=False)  # -> Vector, Length; disabled

neg_5 = Negative(Value=xprod_2.Vector)  # disabled

pl_2 = ConstructPlane(Origin=eval.Point, XAxis=neg_5, YAxis=Z_4)  # disabled

move_33 = Move(Geometry=pl_2, Motion=neg_3)  # -> Geometry, Transform; disabled
orient_3 = Orient(Geometry=group, Source=xy, Target=move_33.Geometry)  # -> Geometry, Transform; disabled
mirror = Mirror(Geometry=orient_3.Geometry, Plane=pl)  # -> Geometry, Transform; disabled
merge_4 = Merge(Data1=orient_3.Geometry, Data2=mirror.Geometry)  # disabled
ungroup_3 = Ungroup(Group=merge_4)  # disabled
ungroup_4 = Ungroup(Group=merge_4)  # disabled
pipe = Pipe(Curve=ungroup_4, Radius=number_slider_12, Caps=0)  # disabled
preview_13 = CustomPreview(Geometry=pipe, Material=swatch_2)  # disabled

pipeline_3 = GeometryPipeline(
    GroupByLayer=False,
    GroupByType=False,
    IncludeHidden=True,
    IncludeLocked=True,
    LayerFilter="Design::Manual::2",
    NameFilter="*",
    SublayerFiltering=True,
    TypeFilter=4)
crv_20 = Curve(pipeline_3)
explode_3 = Explode(Curve=crv_20, Recursive=True)  # -> Segments, Vertices
llinter_2 = LineLineIntersectionKaramba3D(Line=explode_3.Segments, LimitDistance_m=0.005)  # -> IntersectionPoints, flatten(LineSubSegements)
pt_25 = Point(flatten(explode_3.Vertices))
pdecon_2 = Deconstruct(Point=pt_25)  # -> XComponent, YComponent, ZComponent
sort_2 = SortList(Keys=pdecon_2.ZComponent, ValuesA=pt_25)  # -> Keys, ValuesA
crosecrselect_2 = CrossSectionRangeSelectorKaramba3D(MaximumHeight_cm=-1, MaximumWidth_cm=-1, menu=[dropdown(1), dropdown(3), dropdown(1)])
item_11 = ListItem(List=sort_2.Keys, Index=0, Wrap=True)
equals_15 = Equality(FirstNumber=item_11, SecondNumber=pdecon_2.ZComponent)  # -> Equality, Inequality
cull = CullPattern(List=pt_25, CullPattern=equals_15.Equality)
cullpt = CullDuplicates(Points=cull, Tolerance=0.1, CullMode=1)  # -> Points, Indices, Valence
item_12 = ListItem(List=crosecrselect_2, Index=0, Wrap=True)
supp_3 = SupportKaramba3D(PosInd=cullpt.Points, menu=[buttons(on, on, on, on, on, on)])
linetobeam_2 = LineToBeamKaramba3D(
    Line=llinter_2.LineSubSegements,
    CrossSection=item_12,
    New=True,
    Remove=True,
    LimitDistance_m=0.005,
    Bending=True,
    SetBucklingLength=True,
    ToPolylineMaxAngle=0.03,
    ToPolylineTolerance=0.01,
    ToPolylineMaxEdgeLength=0.25)  # -> Element, Points, Info
support_2 = SupportKaramba3D(supp_3)

pt_26 = Point(flatten(explode_3.Vertices))
pdecon_3 = Deconstruct(Point=pt_26)  # -> XComponent, YComponent, ZComponent
sort_3 = SortList(Keys=pdecon_3.ZComponent, ValuesA=pt_26)  # -> Keys, ValuesA
item_13 = ListItem(List=reverse(sort_3.Keys), Index=0, Wrap=True)
equals_16 = Equality(FirstNumber=item_13, SecondNumber=pdecon_3.ZComponent)  # -> Equality, Inequality
cull_2 = CullPattern(List=pt_26, CullPattern=equals_16.Equality)
cullpt_2 = CullDuplicates(Points=cull_2, Tolerance=0.1, CullMode=1)  # -> Points, Indices, Valence
loads_4 = LoadsKaramba3D(ForceVector=neg_4, Local=False, PosInd=cullpt_2.Points, LCase="0", mode="Point")
load_2 = LoadKaramba3D(flatten([loads_4, loads_3]))

assemble_2 = AssembleModelKaramba3D(Elem=linetobeam_2.Element, Support=support_2, Load=load_2, LimitDistance_m=0.005)  # -> Model, Info, Mass_kg, CenterOfGravity, LoadCaseNames
opticrosec_2 = OptimizeCrossSectionKaramba3D(
    Model=assemble_2.Model,
    CrossSections=crosecrselect_2,
    MaximumUtilization=1,
    UltimateLimitStateIterations=5,
    DisplacementIterations=5,
    NumberOfSamplePoints=3,
    ElasticDesign=True,
    GammaM0=1,
    GammaM1=1.1,
    SwayFrame=True)  # -> ModelWithOptimizedCrossSections, Info, Mass_kg, MaximumDisplacement_cm, ElasticEnergyChange_kNm
modelview_2 = ModelViewKaramba3D(Model=opticrosec_2.ModelWithOptimizedCrossSections, ResultFactors=1, ResultCase=-1)  # -> Model, DeformedMesh, DeformedAxes, DeformedModel
beamview_2 = BeamViewKaramba3D(Model=modelview_2.Model)  # -> Model, MeshesOfRenderedBeams, DeformedBeamAxes, LegendColors, LegendTags

mesh = Mesh(beamview_2.MeshesOfRenderedBeams)

# ==== cluster MakeAssembly
loads = ClusterInput()
supports = ClusterInput()
boundary = ClusterInput()
loads_2 = Data(loads)
supports_2 = Data(supports)
boundary_2 = Data(boundary)
python_script = PythonScript(Loads=loads_2, Supports=supports_2, Boundary=boundary_2)  # -> StartShape; inputs Loads: list, Supports: list, Boundary: Curve
# ---------- python_script: Python ----------
import rhinoscriptsyntax as rs
import ghpythonlib.components as ghcomp
import Rhino.Geometry as rg
import Rhino as rc
import Rules as r
import System.Drawing as sd


################################################################################
#  IMPORT JUNEY FILES

import Assembly as assembly
import Grammar as gr

reload(assembly)
################################################################################
#  COMPILE NODES

NodeList = []
NodeList.extend(Loads)
NodeList.extend(Supports)


################################################################################
#  CREATE ASSEMBLY INSTANCE

StartShape = assembly.Assembly(NodeList, [], Boundary)

print StartShape.MyState
print len(StartShape.Nodes)
# ---------- end python_script ----------
S = Script()  # -> out, a; unedited script template
startshape = ClusterOutput(python_script)

# ==== cluster PINSUPPORT
support_location = ClusterInput()
color = ClusterInput()
lineweight_scale = ClusterInput()
visual_scale = ClusterInput()

# ---- group: SUPPORT LOCATION
support_location_2 = Point(support_location)

# ----
color_2 = Colour(color)

# ---- group: VISUAL SCALE
multiplication = Multiplication(A=1, VisualScale=visual_scale)

# ---- group: LINEWEIGHT
multiplication_2 = Multiplication(A=1, LineweightScale=lineweight_scale)

# ----
deconstruct = Deconstruct(Point=support_location_2)  # -> XComponent, YComponent, ZComponent
construct_point = ConstructPoint(XCoordinate=expr("X+0.6", deconstruct.XComponent), YCoordinate=expr("X-1", deconstruct.YComponent), ZCoordinate=0)
construct_point_2 = ConstructPoint(XCoordinate=expr("X-0.6", deconstruct.XComponent), YCoordinate=expr("X-1", deconstruct.YComponent), ZCoordinate=0)
construct_point_3 = ConstructPoint(XCoordinate=expr("X+1", deconstruct.XComponent), YCoordinate=expr("X-1", deconstruct.YComponent), ZCoordinate=0)
construct_point_4 = ConstructPoint(XCoordinate=expr("X-1", deconstruct.XComponent), YCoordinate=expr("X-1", deconstruct.YComponent), ZCoordinate=0)
construct_point_5 = ConstructPoint(XCoordinate=expr("X+1", deconstruct.XComponent), YCoordinate=expr("X-1.5", deconstruct.YComponent), ZCoordinate=0)
construct_point_6 = ConstructPoint(XCoordinate=expr("X-1", deconstruct.XComponent), YCoordinate=expr("X-1.5", deconstruct.YComponent), ZCoordinate=0)

# ---- group: Triangle
polyline = PolyLine(Vertices=[support_location_2, construct_point_2, construct_point], Closed=True)

# ----
polyline_2 = PolyLine(Vertices=[construct_point_3, construct_point_4, construct_point_6, construct_point_5], Closed=True)
line = Line(StartPoint=construct_point_3, EndPoint=construct_point_4)
createhatch = CreateHatch(Bake=False, Curves=polyline_2, HatchPatternName="Hatch1", HatchScale=1, HatchRotation=expr("45*pi/180", 0))

scale = Scale(Geometry=polyline, Center=support_location_2, Factor=multiplication)  # -> Geometry, Transform
scale_2 = Scale(Geometry=createhatch, Center=support_location_2, Factor=multiplication)  # -> Geometry, Transform
multiplication_3 = Multiplication(A=2, B=multiplication_2)
multiplication_4 = Multiplication(A=1, B=multiplication_2)
custom_preview_lineweights = CustomPreviewLineweights(Geometry=scale.Geometry, Shader=color_2, Thickness=multiplication_3)
custom_preview_lineweights_2 = CustomPreviewLineweights(Geometry=scale_2.Geometry, Shader=color_2, Thickness=multiplication_4)

scale_3 = Scale(Geometry=line, Center=support_location_2, Factor=multiplication)  # -> Geometry, Transform
multiplication_5 = Multiplication(A=4, B=multiplication_2)
custom_preview_lineweights_3 = CustomPreviewLineweights(Geometry=scale_3.Geometry, Shader=color_2, Thickness=multiplication_5)

# ==== cluster Cluster
line = ClusterInput()
line_2 = Line(line)
vector = Vector(line_2)
end_points = EndPoints(Curve=line_2)  # -> Start, End
vector_display_ex = VectorDisplayEx(Point=end_points.Start, Vector=vector, Colour=ColourSwatch(SwatchColor=RGB(100, 0, 38)), Width=1)

# ==== cluster Cluster_2
line = ClusterInput()
line_2 = Line(line)
vector = Vector(line_2)
end_points = EndPoints(Curve=line_2)  # -> Start, End
colour_swatch = ColourSwatch(SwatchColor=RGB(225, 212, 38))
force_display = ForceDisplay(line=graft(line_2), force_type="1", tension_compresion="1", colour=colour_swatch)
vector_display_ex = VectorDisplayEx(Point=end_points.Start, Vector=vector, Colour=colour_swatch, Width=2)  # disabled

# ==== cluster ForceDisplay_2
force_type = ClusterInput()
tension_compresion = ClusterInput()
line = ClusterInput()
colour = ClusterInput()
force_type_2 = Number(force_type)
tension_compresion_2 = Number(tension_compresion)
line_2 = Line(line)
end_points = EndPoints(Curve=line_2)  # -> Start, End
equality = Equality(FirstNumber=tension_compresion_2, SecondNumber=1)  # -> Equality, Inequality
equality_2 = Equality(FirstNumber=tension_compresion_2, SecondNumber=-1)  # -> Equality, Inequality
vector_2pt = Vector2Pt(PointA=end_points.End, PointB=end_points.Start, Unitize=False)  # -> Vector, Length
dispatch = Dispatch(List="1", DispatchPattern=equality.Equality)  # -> ListA, ListB
dispatch_2 = Dispatch(List="2", DispatchPattern=equality_2.Equality)  # -> ListA, ListB
colour_2 = Colour(colour)
radians = Radians(Degrees="13")
rotate = Rotate(Geometry=vector_2pt.Vector, Angle=radians, Plane=PlaneXY(0, 0, 0))  # -> Geometry, Transform

amplitude = Amplitude(Vector=vector_2pt.Vector, Amplitude="0.8")
move = Move(Geometry=end_points.End, Motion=amplitude)  # -> Geometry, Transform

line_3 = Line(StartPoint=end_points.Start, EndPoint=move.Geometry)
custom_preview_lineweights = CustomPreviewLineweights(Geometry=line_3, Shader=colour_2, Thickness=[dispatch.ListA, dispatch_2.ListA])
rotate_2 = Rotate(Geometry=vector_2pt.Vector, Angle=expr("x*-1", radians), Plane=PlaneXY(0, 0, 0))  # -> Geometry, Transform
amplitude_2 = Amplitude(Vector=rotate.Geometry, Amplitude="1")
amplitude_3 = Amplitude(Vector=rotate_2.Geometry, Amplitude="1")
move_2 = Move(Geometry=end_points.End, Motion=amplitude_3)  # -> Geometry, Transform
move_3 = Move(Geometry=end_points.End, Motion=amplitude_2)  # -> Geometry, Transform
point = Point(end_points.End)
polyline = PolyLine(Vertices=[point, move_2.Geometry, move.Geometry, move_3.Geometry], Closed=True)
createhatch = CreateHatch(Bake=False, Curves=polyline, HatchPatternName="Hatch1", HatchScale=0.01, HatchRotation=0)
custom_preview_lineweights_2 = CustomPreviewLineweights(Geometry=polyline, Shader=colour_2, Thickness=1)
custom_preview = CustomPreview(Geometry=createhatch, Shader=colour_2)

# ==== cluster ForceDisplay
force_type = ClusterInput()
tension_compresion = ClusterInput()
line = ClusterInput()
colour = ClusterInput()
force_type_2 = Number(force_type)
tension_compresion_2 = Number(tension_compresion)
line_2 = Line(line)
end_points = EndPoints(Curve=line_2)  # -> Start, End
equality = Equality(FirstNumber=tension_compresion_2, SecondNumber=1)  # -> Equality, Inequality
vector_2pt = Vector2Pt(PointA=end_points.End, PointB=end_points.Start, Unitize=False)  # -> Vector, Length
dispatch = Dispatch(List="3", DispatchPattern=equality.Equality)  # -> ListA, ListB
colour_2 = Colour(colour)
radians = Radians(Degrees="15")
rotate = Rotate(Geometry=vector_2pt.Vector, Angle=radians, Plane=PlaneXY(0, 0, 0))  # -> Geometry, Transform

amplitude = Amplitude(Vector=vector_2pt.Vector, Amplitude="1.5")
move = Move(Geometry=end_points.End, Motion=amplitude)  # -> Geometry, Transform

line_3 = Line(StartPoint=end_points.Start, EndPoint=move.Geometry)
custom_preview_lineweights = CustomPreviewLineweights(Geometry=line_3, Shader=colour_2, Thickness=dispatch.ListA)
rotate_2 = Rotate(Geometry=vector_2pt.Vector, Angle=expr("x*-1", radians), Plane=PlaneXY(0, 0, 0))  # -> Geometry, Transform
amplitude_2 = Amplitude(Vector=rotate.Geometry, Amplitude="2")
amplitude_3 = Amplitude(Vector=rotate_2.Geometry, Amplitude="2")
move_2 = Move(Geometry=end_points.End, Motion=amplitude_3)  # -> Geometry, Transform
move_3 = Move(Geometry=end_points.End, Motion=amplitude_2)  # -> Geometry, Transform
point = Point(end_points.End)
polyline = PolyLine(Vertices=[point, move_2.Geometry, move.Geometry, move_3.Geometry], Closed=True)
createhatch = CreateHatch(Bake=False, Curves=polyline, HatchPatternName="Solid", HatchScale=1, HatchRotation=0)
custom_preview_lineweights_2 = CustomPreviewLineweights(Geometry=polyline, Shader=colour_2, Thickness=1)
custom_preview = CustomPreview(Geometry=createhatch, Shader=colour_2)
